# Grasshopper definition Grasshopper script in 3D.gh (Grasshopper 1.0.7)
# plug-ins: Karamba3D, MeshEdit Components

# ----
# Slab Creation
# Structural elements
# Input
# Z-Direction
# X-Direction
# Y-Direction
# Beam Creation
distance_between_columns = Slider(2, range=0..600)
number_of_bays_x_direction = Slider(4, range=0..10)
distance_between_floors = Slider(3, range=0..300)
number_of_floors = Slider(4, range=0..10)
number_of_bays_y_direction = Slider(4, range=0..10)
# Varient 1
distance_between_columns_2 = Slider(2, range=0..600)
multiplication = Multiplication(A=number_of_bays_y_direction, B=distance_between_columns_2)
series = Series(Start=0, Step=distance_between_floors, Count=number_of_floors)
multiplication_2 = Multiplication(A=number_of_bays_x_direction, B=distance_between_columns)
planesrf = PlaneSurface(Plane=PlaneXY(0, 0, 0), XSize=multiplication_2, YSize=multiplication)
sdivide = DivideSurface(Surface=planesrf, UCount=number_of_bays_x_direction, VCount=number_of_bays_y_direction)  # -> flatten(Points), Normals, Parameters
flip = FlipMatrix(Data=sdivide.Parameters)
pline = PolyLine(Vertices=sdivide.Parameters, Closed=False)
pline_2 = PolyLine(Vertices=flip, Closed=False)
explode = Explode(Curve=[pline, pline_2], Recursive=True)  # -> Segments, Vertices
Z = UnitZ(Factor=series)
# Archetype A
# Structural elements
number_slider = Slider(0, range=0..1)
len = Length(Curve=explode.Segments)
move = Move(Geometry=planesrf, Motion=Z)  # -> Geometry, Transform
division = Division(A=len, B=Slider(2, range=0..10))
move_2 = Move(Geometry=sdivide.Points, Motion=graft(Z))  # -> Geometry, Transform
divide = DivideCurve(Curve=explode.Segments, Count=division, Kinks=False)  # -> Points, Tangents, Parameters
cull_i = CullIndex(List=move.Geometry, Indices=number_slider, Wrap=True)
pline_3 = PolyLine(Vertices=divide.Points, Closed=False)
ln = Line(StartPoint=move_2.Geometry, EndPoint=sdivide.Points)
move_3 = Move(Geometry=pline_3, Motion=Z)  # -> Geometry, Transform
mesh_uv = MeshSurface(Surface=cull_i, UCount=5, VCount=5, Overhang=True, Equalize=False)  # -> flatten(Mesh)
cull_i_2 = CullIndex(List=move_3.Geometry, Indices=Slider(0, range=0..1), Wrap=True)
explode_2 = Explode(Curve=cull_i_2, Recursive=distance_between_columns)  # -> Segments, Vertices
linetobeam = LineToBeamKaramba3D(
    Line=explode_2.Segments,
    Identifier="Beam",
    New=True,
    Remove=True,
    LimitDistance_m=0.005,
    Bending=True,
    SetBucklingLength=True,
    ToPolylineMaxAngle=0.03,
    ToPolylineTolerance=0.01,
    ToPolylineMaxEdgeLength=0.25)  # -> Element, Points, Info
linetobeam_2 = LineToBeamKaramba3D(
    Line=ln,
    Identifier="Column",
    New=True,
    Remove=True,
    LimitDistance_m=0.005,
    Bending=True,
    SetBucklingLength=True,
    ToPolylineMaxAngle=0.03,
    ToPolylineTolerance=0.01,
    ToPolylineMaxEdgeLength=0.25)  # -> Element, Points, Info
meshtoshell = MeshToShellKaramba3D(Mesh=mesh_uv, Identifier="Slab", LimitDistance_m=0.005)  # -> Element, Points, Info
merge = Merge(Data1=meshtoshell.Element, Data2=linetobeam_2.Element, Data3=linetobeam.Element)

# ----
# Slab Creation
# Structural elements
# Input
# Z-Direction
# X-Direction
# Y-Direction
# Beam Creation
distance_between_columns_3 = Slider(2, range=0..600)
number_of_bays_x_direction_2 = Slider(8, range=0..10)
distance_between_floors_2 = Slider(3, range=0..300)
number_of_floors_2 = Slider(4, range=0..10)
number_of_bays_y_direction_2 = Slider(4, range=0..10)
# Varient 2
distance_between_columns_4 = Slider(2, range=0..600)
multiplication_3 = Multiplication(A=number_of_bays_y_direction_2, B=distance_between_columns_4)
series_2 = Series(Start=0, Step=distance_between_floors_2, Count=number_of_floors_2)
multiplication_4 = Multiplication(A=number_of_bays_x_direction_2, B=distance_between_columns_3)
planesrf_2 = PlaneSurface(Plane=PlaneXY(0, 0, 0), XSize=multiplication_4, YSize=multiplication_3)
sdivide_2 = DivideSurface(Surface=planesrf_2, UCount=number_of_bays_x_direction_2, VCount=number_of_bays_y_direction_2)  # -> flatten(Points), Normals, Parameters
flip_2 = FlipMatrix(Data=sdivide_2.Parameters)
pline_4 = PolyLine(Vertices=sdivide_2.Parameters, Closed=False)
pline_5 = PolyLine(Vertices=flip_2, Closed=False)
explode_3 = Explode(Curve=[pline_4, pline_5], Recursive=True)  # -> Segments, Vertices
Z_2 = UnitZ(Factor=series_2)
# Structural elements
number_slider_2 = Slider(0, range=0..1)
len_2 = Length(Curve=explode_3.Segments)
move_4 = Move(Geometry=planesrf_2, Motion=Z_2)  # -> Geometry, Transform
division_2 = Division(A=len_2, B=Slider(2, range=0..10))
move_5 = Move(Geometry=sdivide_2.Points, Motion=graft(Z_2))  # -> Geometry, Transform
divide_2 = DivideCurve(Curve=explode_3.Segments, Count=division_2, Kinks=False)  # -> Points, Tangents, Parameters
ln_2 = Line(StartPoint=move_5.Geometry, EndPoint=sdivide_2.Points)
cull_i_3 = CullIndex(List=move_4.Geometry, Indices=number_slider_2, Wrap=True)
pline_6 = PolyLine(Vertices=divide_2.Points, Closed=False)
explode_4 = Explode(Curve=ln_2, Recursive=distance_between_floors_2)  # -> flatten(Segments), Vertices
move_6 = Move(Geometry=pline_6, Motion=Z_2)  # -> Geometry, Transform
mesh_uv_2 = MeshSurface(Surface=cull_i_3, UCount=5, VCount=5, Overhang=True, Equalize=False)  # -> flatten(Mesh)
cull_i_4 = CullIndex(List=move_6.Geometry, Indices=Slider(0, range=0..1), Wrap=True)
explode_5 = Explode(Curve=cull_i_4, Recursive=distance_between_columns_3)  # -> Segments, Vertices
linetobeam_3 = LineToBeamKaramba3D(
    Line=explode_5.Segments,
    Identifier="Beam",
    New=True,
    Remove=True,
    LimitDistance_m=0.005,
    Bending=True,
    SetBucklingLength=True,
    ToPolylineMaxAngle=0.03,
    ToPolylineTolerance=0.01,
    ToPolylineMaxEdgeLength=0.25)  # -> Element, Points, Info
linetobeam_4 = LineToBeamKaramba3D(
    Line=ln_2,
    Identifier="Column",
    New=True,
    Remove=True,
    LimitDistance_m=0.005,
    Bending=True,
    SetBucklingLength=True,
    ToPolylineMaxAngle=0.03,
    ToPolylineTolerance=0.01,
    ToPolylineMaxEdgeLength=0.25)  # -> Element, Points, Info
meshtoshell_2 = MeshToShellKaramba3D(Mesh=mesh_uv_2, Identifier="Slab", LimitDistance_m=0.005)  # -> Element, Points, Info
merge_2 = Merge(Data1=meshtoshell_2.Element, Data2=linetobeam_4.Element, Data3=linetobeam_3.Element)

# ----
# Slab Creation
# Structural elements
# Input
# Z-Direction
# X-Direction
# Y-Direction
# Beam Creation
distance_between_columns_5 = Slider(2, range=0..600)
number_of_bays_x_direction_3 = Slider(4, range=0..10)
distance_between_floors_3 = Slider(3, range=0..300)
number_of_floors_3 = Slider(7, range=0..10)
number_of_bays_y_direction_3 = Slider(4, range=0..10)
# Varient 3
distance_between_columns_6 = Slider(2, range=0..600)
multiplication_5 = Multiplication(A=number_of_bays_y_direction_3, B=distance_between_columns_6)
series_3 = Series(Start=0, Step=distance_between_floors_3, Count=number_of_floors_3)
multiplication_6 = Multiplication(A=number_of_bays_x_direction_3, B=distance_between_columns_5)
planesrf_3 = PlaneSurface(Plane=PlaneXY(0, 0, 0), XSize=multiplication_6, YSize=multiplication_5)
sdivide_3 = DivideSurface(Surface=planesrf_3, UCount=number_of_bays_x_direction_3, VCount=number_of_bays_y_direction_3)  # -> flatten(Points), Normals, Parameters
flip_3 = FlipMatrix(Data=sdivide_3.Parameters)
pline_7 = PolyLine(Vertices=sdivide_3.Parameters, Closed=False)
pline_8 = PolyLine(Vertices=flip_3, Closed=False)
explode_6 = Explode(Curve=[pline_7, pline_8], Recursive=True)  # -> Segments, Vertices
Z_3 = UnitZ(Factor=series_3)
# Structural elements
number_slider_3 = Slider(0, range=0..1)
len_3 = Length(Curve=explode_6.Segments)
move_7 = Move(Geometry=planesrf_3, Motion=Z_3)  # -> Geometry, Transform
division_3 = Division(A=len_3, B=Slider(2, range=0..10))
move_8 = Move(Geometry=sdivide_3.Points, Motion=graft(Z_3))  # -> Geometry, Transform
divide_3 = DivideCurve(Curve=explode_6.Segments, Count=division_3, Kinks=False)  # -> Points, Tangents, Parameters
ln_3 = Line(StartPoint=move_8.Geometry, EndPoint=sdivide_3.Points)
cull_i_5 = CullIndex(List=move_7.Geometry, Indices=number_slider_3, Wrap=True)
pline_9 = PolyLine(Vertices=divide_3.Points, Closed=False)
explode_7 = Explode(Curve=ln_3, Recursive=distance_between_floors_3)  # -> flatten(Segments), Vertices
move_9 = Move(Geometry=pline_9, Motion=Z_3)  # -> Geometry, Transform
mesh_uv_3 = MeshSurface(Surface=cull_i_5, UCount=5, VCount=5, Overhang=True, Equalize=False)  # -> flatten(Mesh)
cull_i_6 = CullIndex(List=move_9.Geometry, Indices=Slider(0, range=0..1), Wrap=True)
explode_8 = Explode(Curve=cull_i_6, Recursive=distance_between_columns_5)  # -> Segments, Vertices
linetobeam_5 = LineToBeamKaramba3D(
    Line=explode_8.Segments,
    Identifier="Beam",
    New=True,
    Remove=True,
    LimitDistance_m=0.005,
    Bending=True,
    SetBucklingLength=True,
    ToPolylineMaxAngle=0.03,
    ToPolylineTolerance=0.01,
    ToPolylineMaxEdgeLength=0.25)  # -> Element, Points, Info
linetobeam_6 = LineToBeamKaramba3D(
    Line=ln_3,
    Identifier="Column",
    New=True,
    Remove=True,
    LimitDistance_m=0.005,
    Bending=True,
    SetBucklingLength=True,
    ToPolylineMaxAngle=0.03,
    ToPolylineTolerance=0.01,
    ToPolylineMaxEdgeLength=0.25)  # -> Element, Points, Info
meshtoshell_3 = MeshToShellKaramba3D(Mesh=mesh_uv_3, Identifier="Slab", LimitDistance_m=0.005)  # -> Element, Points, Info
merge_3 = Merge(Data1=meshtoshell_3.Element, Data2=linetobeam_6.Element, Data3=linetobeam_5.Element)

sframes = SurfaceFrames(Surface=planesrf_2, UCount=distance_between_columns_3, VCount=distance_between_columns_4)  # -> Frames, Parameters
sframes_2 = SurfaceFrames(Surface=planesrf_3, UCount=distance_between_columns_5, VCount=distance_between_columns_6)  # -> Frames, Parameters

# ----
# Mesh Load
mesh = Mesh(flatten(mesh_uv))
area = Area(Geometry=mesh)  # -> Area, Centroid
Z_4 = UnitZ(Factor="1")
scale = Scale(Geometry=mesh, Center=area.Centroid, Factor="1.8")  # -> flatten(Geometry), Transform
load_kn_m2 = Panel("-1")
Z_5 = UnitZ(Factor=load_kn_m2)
move_10 = Move(Geometry=scale.Geometry, Motion=Z_4)  # -> Geometry, Transform

# ----
# Mesh Load
mesh_2 = Mesh(flatten(mesh_uv_2))
area_2 = Area(Geometry=mesh_2)  # -> Area, Centroid
Z_6 = UnitZ(Factor="1")
scale_2 = Scale(Geometry=mesh_2, Center=area_2.Centroid, Factor="1.8")  # -> flatten(Geometry), Transform
load_kn_m2_2 = Panel("-1")
Z_7 = UnitZ(Factor=load_kn_m2_2)
move_11 = Move(Geometry=scale_2.Geometry, Motion=Z_6)  # -> Geometry, Transform

# ----
# Mesh Load
mesh_3 = Mesh(flatten(mesh_uv_3))
area_3 = Area(Geometry=mesh_3)  # -> Area, Centroid
Z_8 = UnitZ(Factor="1")
scale_3 = Scale(Geometry=mesh_3, Center=area_3.Centroid, Factor="1.8")  # -> flatten(Geometry), Transform
load_kn_m2_3 = Panel("-1")
Z_9 = UnitZ(Factor=load_kn_m2_3)
move_12 = Move(Geometry=scale_3.Geometry, Motion=Z_8)  # -> Geometry, Transform

# ----
# Gravity
Z_10 = UnitZ(Factor=Slider(1, range=0..10))
rev = Reverse(Vector=Z_10)

# ----
# Gravity
Z_11 = UnitZ(Factor=Slider(1, range=0..10))
rev_2 = Reverse(Vector=Z_11)

# ----
# Gravity
Z_12 = UnitZ(Factor=Slider(1, range=0..10))
rev_3 = Reverse(Vector=Z_12)

dimentions_cm = Panel("10")
dimentions_cm_2 = Panel("12")
dimentions_cm_3 = Panel("30")
dimentions_cm_4 = Panel("30")
dimentions_cm_5 = Panel("35")

# ----
# list of cross sections
# list of cross sections
dimentions_cm_6 = Panel("23")
dimentions_cm_7 = Panel("10")
height_cm = Panel("7.5")
cross_section = CrossSectionKaramba3D(
    FamilyNameOfCrossSection="DefaultCroSec",
    ElementIdentifier="Beam",
    Material=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,
    Height_cm=dimentions_cm_6,
    UpperFlangeWidth_cm=dimentions_cm,
    LowerFlangeWidth_cm=dimentions_cm,
    mode="Trapezoid")
cross_section_2 = CrossSectionKaramba3D(
    FamilyNameOfCrossSection="DefaultCroSec",
    ElementIdentifier="Column",
    Material=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,
    Height_cm=dimentions_cm_4,
    UpperFlangeWidth_cm=dimentions_cm_7,
    LowerFlangeWidth_cm=dimentions_cm_7,
    mode="Trapezoid")
cross_section_3 = CrossSectionKaramba3D(
    FamilyNameOfCrossSection="DefaultCroSec",
    ElementIdentifier="Slab",
    Material=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,
    Height_cm=height_cm,
    mode="Shell - Const")
merge_4 = Merge(Data1=cross_section, Data2=cross_section_2, Data3=cross_section_3)  # -> flatten(Result)

dimentions_cm_8 = Panel("45")

# ----
# list of cross sections
# list of cross sections
dimentions_cm_9 = Panel("35")
dimentions_cm_10 = Panel("12")
height_cm_2 = Panel("7")
cross_section_4 = CrossSectionKaramba3D(
    FamilyNameOfCrossSection="DefaultCroSec",
    ElementIdentifier="Beam",
    Material=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,
    Height_cm=dimentions_cm_9,
    UpperFlangeWidth_cm=dimentions_cm_2,
    LowerFlangeWidth_cm=dimentions_cm_2,
    mode="Trapezoid")
cross_section_5 = CrossSectionKaramba3D(
    FamilyNameOfCrossSection="DefaultCroSec",
    ElementIdentifier="Column",
    Material=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,
    Height_cm=dimentions_cm_5,
    UpperFlangeWidth_cm=dimentions_cm_10,
    LowerFlangeWidth_cm=dimentions_cm_10,
    mode="Trapezoid")
cross_section_6 = CrossSectionKaramba3D(
    FamilyNameOfCrossSection="DefaultCroSec",
    ElementIdentifier="Slab",
    Material=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,
    Height_cm=height_cm_2,
    mode="Shell - Const")
merge_5 = Merge(Data1=cross_section_4, Data2=cross_section_5, Data3=cross_section_6)  # -> flatten(Result)

# ----
# list of cross sections
# list of cross sections
dimentions_cm_11 = Panel("45")
dimentions_cm_12 = Panel("30")
height_cm_3 = Panel("15")
cross_section_7 = CrossSectionKaramba3D(
    FamilyNameOfCrossSection="DefaultCroSec",
    ElementIdentifier="Beam",
    Material=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,
    Height_cm=dimentions_cm_11,
    UpperFlangeWidth_cm=dimentions_cm_3,
    LowerFlangeWidth_cm=dimentions_cm_3,
    mode="Trapezoid")
cross_section_8 = CrossSectionKaramba3D(
    FamilyNameOfCrossSection="DefaultCroSec",
    ElementIdentifier="Column",
    Material=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,
    Height_cm=dimentions_cm_8,
    UpperFlangeWidth_cm=dimentions_cm_12,
    LowerFlangeWidth_cm=dimentions_cm_12,
    mode="Trapezoid")
cross_section_9 = CrossSectionKaramba3D(
    FamilyNameOfCrossSection="DefaultCroSec",
    ElementIdentifier="Slab",
    Material=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,
    Height_cm=height_cm_3,
    mode="Shell - Const")
merge_6 = Merge(Data1=cross_section_7, Data2=cross_section_8, Data3=cross_section_9)  # -> flatten(Result)

loads = LoadsKaramba3D(Vector=rev, LCase="0", mode="Gravity")
loads_2 = LoadsKaramba3D(Vector=rev_2, LCase="0", mode="Gravity")
loads_3 = LoadsKaramba3D(Vector=rev_3, LCase="0", mode="Gravity")
loads_4 = LoadsKaramba3D(Vector=Z_5, Mesh=move_10.Geometry, LCase="1", mode="MeshLoad -Const.", menu=[buttons(off, on, off), buttons(on, on)])
loads_5 = LoadsKaramba3D(Vector=Z_7, Mesh=move_11.Geometry, LCase="1", mode="MeshLoad -Const.", menu=[buttons(off, on, off), buttons(on, on)])
loads_6 = LoadsKaramba3D(Vector=Z_9, Mesh=move_12.Geometry, LCase="1", mode="MeshLoad -Const.", menu=[buttons(off, on, off), buttons(on, on)])
pt = Point(sdivide.Points)
pt_2 = Point(sdivide_2.Points)
pt_3 = Point(sdivide_3.Points)

# ----
# supports
xy = XYPlane(Origin=Point(0, 0, 0))
supp = SupportKaramba3D(PosInd=flatten(pt), PlaneOfReference=xy, menu=[buttons(on, on, on, on, on, on)])

# ----
# supports
xy_2 = XYPlane(Origin=Point(0, 0, 0))
supp_2 = SupportKaramba3D(PosInd=flatten(pt_2), PlaneOfReference=xy_2, menu=[buttons(on, on, on, on, on, on)])

# ----
# supports
xy_3 = XYPlane(Origin=Point(0, 0, 0))
supp_3 = SupportKaramba3D(PosInd=flatten(pt_3), PlaneOfReference=xy_3, menu=[buttons(on, on, on, on, on, on)])

# ----
# Loads
# list of loads
merge_7 = Merge(Data1=loads, Data2=loads_4)  # -> flatten(Result)

# ----
# Loads
# list of loads
merge_8 = Merge(Data1=loads_2, Data2=loads_5)  # -> flatten(Result)

# ----
# Loads
# list of loads
merge_9 = Merge(Data1=loads_3, Data2=loads_6)  # -> flatten(Result)

matselect = MaterialSelectionKaramba3D(menu=[dropdown(7), dropdown(2)])
matselect_2 = MaterialSelectionKaramba3D(menu=[dropdown(7), dropdown(2)])
matselect_3 = MaterialSelectionKaramba3D(menu=[dropdown(7), dropdown(2)])
# Run the Data Dam
assemble = AssembleModelKaramba3D(
    Elem=flatten(merge),
    Support=flatten(supp),
    Load=merge_7,
    CrossSection=merge_4,
    Material=matselect,
    LimitDistance_m=0.005)  # -> Model, Info, Mass_kg, CenterOfGravity, LoadCaseNames
# Run the Data Dam
assemble_2 = AssembleModelKaramba3D(
    Elem=flatten(merge_2),
    Support=flatten(supp_2),
    Load=merge_8,
    CrossSection=merge_5,
    Material=matselect_2,
    LimitDistance_m=0.005)  # -> Model, Info, Mass_kg, CenterOfGravity, LoadCaseNames
# Run the Data Dam
assemble_3 = AssembleModelKaramba3D(
    Elem=flatten(merge_3),
    Support=flatten(supp_3),
    Load=merge_9,
    CrossSection=merge_6,
    Material=matselect_3,
    LimitDistance_m=0.005)  # -> Model, Info, Mass_kg, CenterOfGravity, LoadCaseNames
panel = Panel(assemble.Mass_kg)
panel_2 = Panel(assemble_2.Mass_kg)
panel_3 = Panel(assemble_3.Mass_kg)
dam = DataDam(DataA=assemble.Model, BufferDelay=10000000, BufferMode=0)
dam_2 = DataDam(DataA=assemble_2.Model, BufferDelay=10000000, BufferMode=0)
dam_3 = DataDam(DataA=assemble_3.Model, BufferDelay=10000000, BufferMode=0)
nvibes = NaturalVibrationsKaramba3D(Model=dam, FromIndex=1, NumberOfModes=Slider(1, range=0..10), MaximumNumberOfIterations=30, Epsilon=1e-05)  # -> ModelWithVibrationModesAsLoadCaseResults, flatten(NaturalFrequencies_Hz), ModalMass_kg, ParticipationFactorInGlobalXYAndZDirection
nvibes_2 = NaturalVibrationsKaramba3D(Model=dam_2, FromIndex=1, NumberOfModes=Slider(1, range=0..10), MaximumNumberOfIterations=30, Epsilon=1e-05)  # -> ModelWithVibrationModesAsLoadCaseResults, flatten(NaturalFrequencies_Hz), ModalMass_kg, expr("abs(x)", ParticipationFactorInGlobalXYAndZDirection)
nvibes_3 = NaturalVibrationsKaramba3D(Model=dam_3, FromIndex=1, NumberOfModes=Slider(1, range=0..10), MaximumNumberOfIterations=30, Epsilon=1e-05)  # -> ModelWithVibrationModesAsLoadCaseResults, flatten(NaturalFrequencies_Hz), ModalMass_kg, expr("abs(x)", ParticipationFactorInGlobalXYAndZDirection)
yz = YZPlane(Origin=Point(0, 0, 0))
yz_2 = YZPlane(Origin=Point(0, 0, 0))
yz_3 = YZPlane(Origin=Point(0, 0, 0))
participation_factor = Panel(nvibes_2.ParticipationFactorInGlobalXYAndZDirection)
natural_frequency = Panel(nvibes_2.NaturalFrequencies_Hz)
participation_factor_2 = Panel(nvibes.ParticipationFactorInGlobalXYAndZDirection)
participation_factor_3 = Panel(nvibes_3.ParticipationFactorInGlobalXYAndZDirection)
natural_frequency_2 = Panel(nvibes.NaturalFrequencies_Hz)
natural_frequency_3 = Panel(nvibes_3.NaturalFrequencies_Hz)
modelview = ModelViewKaramba3D(Model=nvibes.ModelWithVibrationModesAsLoadCaseResults, DisplacementDirection=yz, ResultFactors=1, ResultCase=-1)  # -> Model, DeformedMesh, DeformedAxes, DeformedModel
modelview_2 = ModelViewKaramba3D(Model=nvibes_2.ModelWithVibrationModesAsLoadCaseResults, DisplacementDirection=yz_2, ResultFactors=1, ResultCase=-1)  # -> Model, DeformedMesh, DeformedAxes, DeformedModel
modelview_3 = ModelViewKaramba3D(Model=nvibes_3.ModelWithVibrationModesAsLoadCaseResults, DisplacementDirection=yz_3, ResultFactors=1, ResultCase=-1)  # -> Model, DeformedMesh, DeformedAxes, DeformedModel
shellview = ShellViewKaramba3D(Model=modelview.Model, IndexOfLayer=0)  # -> Model, MeshesOfRenderedShells, LegendColors, LegendTags
shellview_2 = ShellViewKaramba3D(Model=modelview_2.Model, IndexOfLayer=0)  # -> Model, MeshesOfRenderedShells, LegendColors, LegendTags
beamview = BeamViewKaramba3D(Model=modelview.Model)  # -> Model, MeshesOfRenderedBeams, DeformedBeamAxes, LegendColors, LegendTags
shellview_3 = ShellViewKaramba3D(Model=modelview_3.Model, IndexOfLayer=0)  # -> Model, MeshesOfRenderedShells, LegendColors, LegendTags
beamview_2 = BeamViewKaramba3D(Model=modelview_2.Model)  # -> Model, MeshesOfRenderedBeams, DeformedBeamAxes, LegendColors, LegendTags
beamview_3 = BeamViewKaramba3D(Model=modelview_3.Model)  # -> Model, MeshesOfRenderedBeams, DeformedBeamAxes, LegendColors, LegendTags
legend = Legend(Colour=shellview.LegendColors, Tags=shellview.LegendTags, LegendType=1)
legend_2 = Legend(Colour=shellview_2.LegendColors, Tags=shellview_2.LegendTags, LegendType=1)
legend_3 = Legend(Colour=shellview_3.LegendColors, Tags=shellview_3.LegendTags, LegendType=1)
legend_4 = Legend(Colour=beamview.LegendColors, Tags=beamview.LegendTags, LegendType=1)
legend_5 = Legend(Colour=beamview_2.LegendColors, Tags=beamview_2.LegendTags, LegendType=1)
legend_6 = Legend(Colour=beamview_3.LegendColors, Tags=beamview_3.LegendTags, LegendType=1)
crv = Curve(modelview.DeformedAxes)
crv_2 = Curve(modelview_2.DeformedAxes)
crv_3 = Curve(modelview_3.DeformedAxes)
item = ListItem(List=crv, Index=Slider(122, range=0..195), Wrap=True)
item_2 = ListItem(List=crv_2, Index=Slider(198, range=0..279), Wrap=True)
item_3 = ListItem(List=crv_3, Index=Slider(365, range=0..390), Wrap=True)
crv_4 = Curve(item)
crv_5 = Curve(item_2)
crv_6 = Curve(item_3)
join = JoinCurves(Curves=crv_4, Preserve=False)
join_2 = JoinCurves(Curves=crv_5, Preserve=False)
join_3 = JoinCurves(Curves=crv_6, Preserve=False)
divide_4 = DivideCurve(Curve=join, Count=Slider(3, range=0..10), Kinks=False)  # -> expr("round(x,3)", reverse(flatten(Points))), Tangents, Parameters
divide_5 = DivideCurve(Curve=join_2, Count=Slider(3, range=0..10), Kinks=False)  # -> expr("round(x,3)", reverse(flatten(Points))), Tangents, Parameters
divide_6 = DivideCurve(Curve=join_3, Count=Slider(6, range=0..10), Kinks=False)  # -> expr("round(x,3)", reverse(flatten(Points))), Tangents, Parameters
expression = Expression(x=divide_4.Points, Expression="abs(x)")
expression_2 = Expression(x=divide_5.Points, Expression="abs(x)")
expression_3 = Expression(x=divide_6.Points, Expression="abs(x)")
pdecon = Deconstruct(Point=expression)  # -> XComponent, YComponent, ZComponent
pdecon_2 = Deconstruct(Point=expression_2)  # -> XComponent, YComponent, ZComponent
pdecon_3 = Deconstruct(Point=expression_3)  # -> XComponent, YComponent, ZComponent
ma = MassAddition(Input=pdecon.YComponent)  # -> Result, PartialResults
ma_2 = MassAddition(Input=pdecon_2.YComponent)  # -> Result, PartialResults
# Extraction of displacement in a plane
ma_3 = MassAddition(Input=pdecon.XComponent)  # -> Result, PartialResults
ma_4 = MassAddition(Input=pdecon_3.YComponent)  # -> Result, PartialResults
# Extraction of displacement in a plane
ma_5 = MassAddition(Input=pdecon_2.XComponent)  # -> Result, PartialResults
# Extraction of displacement in a plane
ma_6 = MassAddition(Input=pdecon_3.XComponent)  # -> Result, PartialResults
expression_4 = Expression(y=ma.Result, Expression="if(y=0, false, true)")
expression_5 = Expression(y=ma_2.Result, Expression="if(y=0, false, true)")
expression_6 = Expression(y=ma_4.Result, Expression="if(y=0, false, true)")
expression_7 = Expression(x=pdecon.XComponent, y=ma_3.Result, Expression="if(y=0, false, true)")
expression_8 = Expression(x=pdecon_2.XComponent, y=ma_5.Result, Expression="if(y=0, false, true)")
expression_9 = Expression(x=pdecon_3.XComponent, y=ma_6.Result, Expression="if(y=0, false, true)")
expression_10 = Expression(x=pdecon.ZComponent, Expression="ROUND(X,0)")
expression_11 = Expression(x=pdecon_2.ZComponent, Expression="ROUND(X,0)")
expression_12 = Expression(x=pdecon_3.ZComponent, Expression="ROUND(X,0)")
cull = CullPattern(List=pdecon.YComponent, CullPattern=expression_4)
cull_2 = CullPattern(List=pdecon_2.YComponent, CullPattern=expression_5)
cull_3 = CullPattern(List=pdecon_3.YComponent, CullPattern=expression_6)
cull_4 = CullPattern(List=pdecon.XComponent, CullPattern=expression_7)
cull_5 = CullPattern(List=pdecon_2.XComponent, CullPattern=expression_8)
cull_6 = CullPattern(List=pdecon_3.XComponent, CullPattern=expression_9)
merge_10 = Merge(Data1=graft(cull_4), Data2=graft(cull), Data3=graft(expression_10))
merge_11 = Merge(Data1=graft(cull_5), Data2=graft(cull_2), Data3=graft(expression_11))
merge_12 = Merge(Data1=graft(cull_6), Data2=graft(cull_3), Data3=graft(expression_12))
join_4 = TextJoin(Text=merge_10, Join=",")  # -> flatten(Result)
join_5 = TextJoin(Text=merge_11, Join=",")  # -> flatten(Result)
join_6 = TextJoin(Text=merge_12, Join=",")  # -> flatten(Result)
# Displacement Values
panel_4 = Panel(join_4)
# Displacement Values
panel_5 = Panel(join_5)
# Displacement Values
panel_6 = Panel(join_6)
# ArchetypeB
number_slider_4 = Slider(3, range=0..10)

# ----
# Gravity
Z_13 = UnitZ(Factor=Slider(1, range=0..10))
rev_4 = Reverse(Vector=Z_13)

# ----
# Gravity
Z_14 = UnitZ(Factor=Slider(1, range=0..10))
rev_5 = Reverse(Vector=Z_14)

# ----
# Gravity
Z_15 = UnitZ(Factor=Slider(1, range=0..10))
rev_6 = Reverse(Vector=Z_15)

dimentions_cm_13 = Panel("15")
dimentions_cm_14 = Panel("10")
dimentions_cm_15 = Panel("25")
dimentions_cm_16 = Panel("30")
dimentions_cm_17 = Panel("60")

# ----
# list of cross sections
# list of cross sections
dimentions_cm_18 = Panel("30")
dimentions_cm_19 = Panel("15")
height_cm_4 = Panel("8")
cross_section_10 = CrossSectionKaramba3D(
    FamilyNameOfCrossSection="DefaultCroSec",
    ElementIdentifier="Beam",
    Material=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,
    Height_cm=dimentions_cm_18,
    UpperFlangeWidth_cm=dimentions_cm_13,
    LowerFlangeWidth_cm=dimentions_cm_13,
    mode="Trapezoid")
cross_section_11 = CrossSectionKaramba3D(
    FamilyNameOfCrossSection="DefaultCroSec",
    ElementIdentifier="Column",
    Material=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,
    Height_cm=dimentions_cm_16,
    UpperFlangeWidth_cm=dimentions_cm_19,
    LowerFlangeWidth_cm=dimentions_cm_19,
    mode="Trapezoid")
cross_section_12 = CrossSectionKaramba3D(
    FamilyNameOfCrossSection="DefaultCroSec",
    ElementIdentifier="Slab",
    Material=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,
    Height_cm=height_cm_4,
    mode="Shell - Const")
merge_13 = Merge(Data1=cross_section_10, Data2=cross_section_11, Data3=cross_section_12)  # -> flatten(Result)

dimentions_cm_20 = Panel("40")

# ----
# list of cross sections
# list of cross sections
dimentions_cm_21 = Panel("60")
dimentions_cm_22 = Panel("10")
height_cm_5 = Panel("7")
cross_section_13 = CrossSectionKaramba3D(
    FamilyNameOfCrossSection="DefaultCroSec",
    ElementIdentifier="Beam",
    Material=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,
    Height_cm=dimentions_cm_21,
    UpperFlangeWidth_cm=dimentions_cm_14,
    LowerFlangeWidth_cm=dimentions_cm_14,
    mode="Trapezoid")
cross_section_14 = CrossSectionKaramba3D(
    FamilyNameOfCrossSection="DefaultCroSec",
    ElementIdentifier="Column",
    Material=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,
    Height_cm=dimentions_cm_17,
    UpperFlangeWidth_cm=dimentions_cm_22,
    LowerFlangeWidth_cm=dimentions_cm_22,
    mode="Trapezoid")
cross_section_15 = CrossSectionKaramba3D(
    FamilyNameOfCrossSection="DefaultCroSec",
    ElementIdentifier="Slab",
    Material=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,
    Height_cm=height_cm_5,
    mode="Shell - Const")
merge_14 = Merge(Data1=cross_section_13, Data2=cross_section_14, Data3=cross_section_15)  # -> flatten(Result)

# ----
# list of cross sections
# list of cross sections
dimentions_cm_23 = Panel("30")
dimentions_cm_24 = Panel("25")
height_cm_6 = Panel("10")
cross_section_16 = CrossSectionKaramba3D(
    FamilyNameOfCrossSection="DefaultCroSec",
    ElementIdentifier="Beam",
    Material=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,
    Height_cm=dimentions_cm_23,
    UpperFlangeWidth_cm=dimentions_cm_15,
    LowerFlangeWidth_cm=dimentions_cm_15,
    mode="Trapezoid")
cross_section_17 = CrossSectionKaramba3D(
    FamilyNameOfCrossSection="DefaultCroSec",
    ElementIdentifier="Column",
    Material=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,
    Height_cm=dimentions_cm_20,
    UpperFlangeWidth_cm=dimentions_cm_24,
    LowerFlangeWidth_cm=dimentions_cm_24,
    mode="Trapezoid")
cross_section_18 = CrossSectionKaramba3D(
    FamilyNameOfCrossSection="DefaultCroSec",
    ElementIdentifier="Slab",
    Material=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,
    Height_cm=height_cm_6,
    mode="Shell - Const")
merge_15 = Merge(Data1=cross_section_16, Data2=cross_section_17, Data3=cross_section_18)  # -> flatten(Result)

loads_7 = LoadsKaramba3D(Vector=rev_4, LCase="0", mode="Gravity")
loads_8 = LoadsKaramba3D(Vector=rev_5, LCase="0", mode="Gravity")
loads_9 = LoadsKaramba3D(Vector=rev_6, LCase="0", mode="Gravity")
panel_7 = Panel("""1
3""")
panel_8 = Panel("""0
2""")
panel_9 = Panel("""1
3""")
panel_10 = Panel("""0
2""")
panel_11 = Panel("""1
3""")
panel_12 = Panel("""0
2""")
Y = UnitY(Factor=1)
Z_16 = UnitZ(Factor=1)
Y_2 = UnitY(Factor=1)
X = UnitX(Factor=1)
Z_17 = UnitZ(Factor=1)
Z_18 = UnitZ(Factor=1)
Y_3 = UnitY(Factor=1)
X_2 = UnitX(Factor=1)
Z_19 = UnitZ(Factor=1)
Z_20 = UnitZ(Factor=1)
X_3 = UnitX(Factor=1)
Z_21 = UnitZ(Factor=1)
matselect_4 = MaterialSelectionKaramba3D(menu=[dropdown(7), dropdown(2)])
matselect_5 = MaterialSelectionKaramba3D(menu=[dropdown(7), dropdown(2)])
matselect_6 = MaterialSelectionKaramba3D(menu=[dropdown(7), dropdown(2)])
number_slider_5 = Slider(3, range=0..10)
number_slider_6 = Slider(3, range=0..10)
panel_13 = Panel("""0
2
4
6""")
panel_14 = Panel("""0
2
4
6""")
panel_15 = Panel("""0
2
4
6""")
panel_16 = Panel("""33
35
37
39""")
panel_17 = Panel("""33
35
37
39""")
panel_18 = Panel("""65
67
69
71""")
yz_4 = YZPlane(Origin=Point(0, 0, 0))
yz_5 = YZPlane(Origin=Point(0, 0, 0))
yz_6 = YZPlane(Origin=Point(0, 0, 0))

# ----
# Slab Creation
# Structural elements
# Input
# Z-Direction
# X-Direction
# Y-Direction
# Beam Creation
distance_between_columns_7 = Slider(2, range=0..600)
number_of_bays_x_direction_4 = Slider(4, range=0..10)
distance_between_floors_4 = Slider(3, range=0..300)
number_of_floors_4 = Slider(4, range=0..10)
number_of_bays_y_direction_4 = Slider(4, range=0..10)
distance_between_columns_8 = Slider(2, range=0..600)
multiplication_7 = Multiplication(A=number_of_bays_y_direction_4, B=distance_between_columns_8)
series_4 = Series(Start=0, Step=distance_between_floors_4, Count=number_of_floors_4)
multiplication_8 = Multiplication(A=number_of_bays_x_direction_4, B=distance_between_columns_7)
planesrf_4 = PlaneSurface(Plane=PlaneXY(0, 0, 0), XSize=multiplication_8, YSize=multiplication_7)
sdivide_4 = DivideSurface(Surface=planesrf_4, UCount=number_of_bays_x_direction_4, VCount=number_of_bays_y_direction_4)  # -> flatten(Points), Normals, Parameters
flip_4 = FlipMatrix(Data=sdivide_4.Parameters)
pline_10 = PolyLine(Vertices=sdivide_4.Parameters, Closed=False)
pline_11 = PolyLine(Vertices=flip_4, Closed=False)
explode_9 = Explode(Curve=[pline_10, pline_11], Recursive=True)  # -> Segments, Vertices
Z_22 = UnitZ(Factor=series_4)
# Archetype C
number_slider_7 = Slider(0, range=0..1)
len_4 = Length(Curve=explode_9.Segments)
move_13 = Move(Geometry=planesrf_4, Motion=Z_22)  # -> Geometry, Transform
division_4 = Division(A=len_4, B=Slider(2, range=0..10))
move_14 = Move(Geometry=sdivide_4.Points, Motion=graft(Z_22))  # -> Geometry, Transform
divide_7 = DivideCurve(Curve=explode_9.Segments, Count=division_4, Kinks=False)  # -> Points, Tangents, Parameters
ln_4 = Line(StartPoint=move_14.Geometry, EndPoint=sdivide_4.Points)
cull_i_7 = CullIndex(List=move_13.Geometry, Indices=number_slider_7, Wrap=True)
pline_12 = PolyLine(Vertices=divide_7.Points, Closed=False)
explode_10 = Explode(Curve=ln_4, Recursive=distance_between_floors_4)  # -> flatten(Segments), Vertices
move_15 = Move(Geometry=pline_12, Motion=Z_22)  # -> Geometry, Transform
mesh_uv_4 = MeshSurface(Surface=cull_i_7, UCount=5, VCount=5, Overhang=True, Equalize=False)  # -> flatten(Mesh)
cull_i_8 = CullIndex(List=move_15.Geometry, Indices=Slider(0, range=0..1), Wrap=True)
explode_11 = Explode(Curve=cull_i_8, Recursive=distance_between_columns_7)  # -> Segments, Vertices
# Structural elements
panel_19 = Panel("Slab")
linetobeam_7 = LineToBeamKaramba3D(
    Line=explode_11.Segments,
    Identifier="Beam",
    New=True,
    Remove=True,
    LimitDistance_m=0.005,
    Bending=True,
    SetBucklingLength=True,
    ToPolylineMaxAngle=0.03,
    ToPolylineTolerance=0.01,
    ToPolylineMaxEdgeLength=0.25)  # -> Element, Points, Info
linetobeam_8 = LineToBeamKaramba3D(
    Line=ln_4,
    Identifier="Column",
    New=True,
    Remove=True,
    LimitDistance_m=0.005,
    Bending=True,
    SetBucklingLength=True,
    ToPolylineMaxAngle=0.03,
    ToPolylineTolerance=0.01,
    ToPolylineMaxEdgeLength=0.25)  # -> Element, Points, Info
meshtoshell_4 = MeshToShellKaramba3D(Mesh=mesh_uv_4, Identifier=panel_19, LimitDistance_m=0.005)  # -> Element, Points, Info
merge_16 = Merge(Data1=meshtoshell_4.Element, Data2=linetobeam_8.Element, Data3=linetobeam_7.Element)

# ----
# Slab Creation
# Structural elements
# Input
# Z-Direction
# X-Direction
# Y-Direction
# Beam Creation
distance_between_columns_9 = Slider(2, range=0..600)
number_of_bays_x_direction_5 = Slider(8, range=0..10)
distance_between_floors_5 = Slider(3, range=0..300)
number_of_floors_5 = Slider(4, range=0..10)
number_of_bays_y_direction_5 = Slider(4, range=0..10)
distance_between_columns_10 = Slider(2, range=0..600)
multiplication_9 = Multiplication(A=number_of_bays_y_direction_5, B=distance_between_columns_10)
series_5 = Series(Start=0, Step=distance_between_floors_5, Count=number_of_floors_5)
multiplication_10 = Multiplication(A=number_of_bays_x_direction_5, B=distance_between_columns_9)
planesrf_5 = PlaneSurface(Plane=PlaneXY(0, 0, 0), XSize=multiplication_10, YSize=multiplication_9)
sdivide_5 = DivideSurface(Surface=planesrf_5, UCount=number_of_bays_x_direction_5, VCount=number_of_bays_y_direction_5)  # -> flatten(Points), Normals, Parameters
flip_5 = FlipMatrix(Data=sdivide_5.Parameters)
pline_13 = PolyLine(Vertices=sdivide_5.Parameters, Closed=False)
pline_14 = PolyLine(Vertices=flip_5, Closed=False)
explode_12 = Explode(Curve=[pline_13, pline_14], Recursive=True)  # -> Segments, Vertices
Z_23 = UnitZ(Factor=series_5)
len_5 = Length(Curve=explode_12.Segments)
move_16 = Move(Geometry=planesrf_5, Motion=Z_23)  # -> Geometry, Transform
division_5 = Division(A=len_5, B=Slider(2, range=0..10))
move_17 = Move(Geometry=sdivide_5.Points, Motion=graft(Z_23))  # -> Geometry, Transform
divide_8 = DivideCurve(Curve=explode_12.Segments, Count=division_5, Kinks=False)  # -> Points, Tangents, Parameters
ln_5 = Line(StartPoint=move_17.Geometry, EndPoint=sdivide_5.Points)
cull_i_9 = CullIndex(List=move_16.Geometry, Indices=Slider(0, range=0..1), Wrap=True)
pline_15 = PolyLine(Vertices=divide_8.Points, Closed=False)
explode_13 = Explode(Curve=ln_5, Recursive=distance_between_floors_5)  # -> flatten(Segments), Vertices
move_18 = Move(Geometry=pline_15, Motion=Z_23)  # -> Geometry, Transform
mesh_uv_5 = MeshSurface(Surface=cull_i_9, UCount=5, VCount=5, Overhang=True, Equalize=False)  # -> flatten(Mesh)
cull_i_10 = CullIndex(List=move_18.Geometry, Indices=Slider(0, range=0..1), Wrap=True)
explode_14 = Explode(Curve=cull_i_10, Recursive=distance_between_columns_9)  # -> Segments, Vertices
# Structural elements
panel_20 = Panel("Slab")
linetobeam_9 = LineToBeamKaramba3D(
    Line=explode_14.Segments,
    Identifier="Beam",
    New=True,
    Remove=True,
    LimitDistance_m=0.005,
    Bending=True,
    SetBucklingLength=True,
    ToPolylineMaxAngle=0.03,
    ToPolylineTolerance=0.01,
    ToPolylineMaxEdgeLength=0.25)  # -> Element, Points, Info
linetobeam_10 = LineToBeamKaramba3D(
    Line=ln_5,
    Identifier="Column",
    New=True,
    Remove=True,
    LimitDistance_m=0.005,
    Bending=True,
    SetBucklingLength=True,
    ToPolylineMaxAngle=0.03,
    ToPolylineTolerance=0.01,
    ToPolylineMaxEdgeLength=0.25)  # -> Element, Points, Info
meshtoshell_5 = MeshToShellKaramba3D(Mesh=mesh_uv_5, Identifier=panel_20, LimitDistance_m=0.005)  # -> Element, Points, Info
merge_17 = Merge(Data1=meshtoshell_5.Element, Data2=linetobeam_10.Element, Data3=linetobeam_9.Element)

# ----
# Slab Creation
# Structural elements
# Input
# Z-Direction
# X-Direction
# Y-Direction
# Beam Creation
distance_between_columns_11 = Slider(2, range=0..600)
number_of_bays_x_direction_6 = Slider(4, range=0..10)
distance_between_floors_6 = Slider(3, range=0..300)
number_of_floors_6 = Slider(7, range=0..10)
number_of_bays_y_direction_6 = Slider(4, range=0..10)
distance_between_columns_12 = Slider(2, range=0..600)
multiplication_11 = Multiplication(A=number_of_bays_y_direction_6, B=distance_between_columns_12)
series_6 = Series(Start=0, Step=distance_between_floors_6, Count=number_of_floors_6)
multiplication_12 = Multiplication(A=number_of_bays_x_direction_6, B=distance_between_columns_11)
planesrf_6 = PlaneSurface(Plane=PlaneXY(0, 0, 0), XSize=multiplication_12, YSize=multiplication_11)
sdivide_6 = DivideSurface(Surface=planesrf_6, UCount=number_of_bays_x_direction_6, VCount=number_of_bays_y_direction_6)  # -> flatten(Points), Normals, Parameters
flip_6 = FlipMatrix(Data=sdivide_6.Parameters)
pline_16 = PolyLine(Vertices=sdivide_6.Parameters, Closed=False)
pline_17 = PolyLine(Vertices=flip_6, Closed=False)
explode_15 = Explode(Curve=[pline_16, pline_17], Recursive=True)  # -> Segments, Vertices
Z_24 = UnitZ(Factor=series_6)
len_6 = Length(Curve=explode_15.Segments)
move_19 = Move(Geometry=planesrf_6, Motion=Z_24)  # -> Geometry, Transform
division_6 = Division(A=len_6, B=Slider(2, range=0..10))
move_20 = Move(Geometry=sdivide_6.Points, Motion=graft(Z_24))  # -> Geometry, Transform
divide_9 = DivideCurve(Curve=explode_15.Segments, Count=division_6, Kinks=False)  # -> Points, Tangents, Parameters
ln_6 = Line(StartPoint=move_20.Geometry, EndPoint=sdivide_6.Points)
cull_i_11 = CullIndex(List=move_19.Geometry, Indices=Slider(0, range=0..1), Wrap=True)
pline_18 = PolyLine(Vertices=divide_9.Points, Closed=False)
explode_16 = Explode(Curve=ln_6, Recursive=distance_between_floors_6)  # -> flatten(Segments), Vertices
move_21 = Move(Geometry=pline_18, Motion=Z_24)  # -> Geometry, Transform
mesh_uv_6 = MeshSurface(Surface=cull_i_11, UCount=5, VCount=5, Overhang=True, Equalize=False)  # -> flatten(Mesh)
cull_i_12 = CullIndex(List=move_21.Geometry, Indices=Slider(0, range=0..1), Wrap=True)
explode_17 = Explode(Curve=cull_i_12, Recursive=distance_between_columns_11)  # -> Segments, Vertices
# Structural elements
panel_21 = Panel("Slab")
linetobeam_11 = LineToBeamKaramba3D(
    Line=explode_17.Segments,
    Identifier="Beam",
    New=True,
    Remove=True,
    LimitDistance_m=0.005,
    Bending=True,
    SetBucklingLength=True,
    ToPolylineMaxAngle=0.03,
    ToPolylineTolerance=0.01,
    ToPolylineMaxEdgeLength=0.25)  # -> Element, Points, Info
linetobeam_12 = LineToBeamKaramba3D(
    Line=ln_6,
    Identifier="Column",
    New=True,
    Remove=True,
    LimitDistance_m=0.005,
    Bending=True,
    SetBucklingLength=True,
    ToPolylineMaxAngle=0.03,
    ToPolylineTolerance=0.01,
    ToPolylineMaxEdgeLength=0.25)  # -> Element, Points, Info
meshtoshell_6 = MeshToShellKaramba3D(Mesh=mesh_uv_6, Identifier=panel_21, LimitDistance_m=0.005)  # -> Element, Points, Info
merge_18 = Merge(Data1=meshtoshell_6.Element, Data2=linetobeam_12.Element, Data3=linetobeam_11.Element)

sframes_3 = SurfaceFrames(Surface=planesrf_4, UCount=distance_between_columns_7, VCount=distance_between_columns_8)  # -> Frames, Parameters
sframes_4 = SurfaceFrames(Surface=planesrf_5, UCount=distance_between_columns_9, VCount=distance_between_columns_10)  # -> Frames, Parameters
sframes_5 = SurfaceFrames(Surface=planesrf_6, UCount=distance_between_columns_11, VCount=distance_between_columns_12)  # -> Frames, Parameters

# ----
# Mesh Load
mesh_4 = Mesh(flatten(mesh_uv_4))
area_4 = Area(Geometry=mesh_4)  # -> Area, Centroid
Z_25 = UnitZ(Factor="1")
scale_4 = Scale(Geometry=mesh_4, Center=area_4.Centroid, Factor="1.8")  # -> flatten(Geometry), Transform
load_kn_m2_4 = Panel("-1")
Z_26 = UnitZ(Factor=load_kn_m2_4)
move_22 = Move(Geometry=scale_4.Geometry, Motion=Z_25)  # -> Geometry, Transform

# ----
# Mesh Load
mesh_5 = Mesh(flatten(mesh_uv_5))
area_5 = Area(Geometry=mesh_5)  # -> Area, Centroid
Z_27 = UnitZ(Factor="1")
scale_5 = Scale(Geometry=mesh_5, Center=area_5.Centroid, Factor="1.8")  # -> flatten(Geometry), Transform
load_kn_m2_5 = Panel("-1")
Z_28 = UnitZ(Factor=load_kn_m2_5)
move_23 = Move(Geometry=scale_5.Geometry, Motion=Z_27)  # -> Geometry, Transform

# ----
# Mesh Load
mesh_6 = Mesh(flatten(mesh_uv_6))
area_6 = Area(Geometry=mesh_6)  # -> Area, Centroid
Z_29 = UnitZ(Factor="1")
scale_6 = Scale(Geometry=mesh_6, Center=area_6.Centroid, Factor="1.8")  # -> flatten(Geometry), Transform
load_kn_m2_6 = Panel("-1")
Z_30 = UnitZ(Factor=load_kn_m2_6)
move_24 = Move(Geometry=scale_6.Geometry, Motion=Z_29)  # -> Geometry, Transform

# ----
# Gravity
Z_31 = UnitZ(Factor=Slider(1, range=0..10))
rev_7 = Reverse(Vector=Z_31)

# ----
# Gravity
Z_32 = UnitZ(Factor=Slider(1, range=0..10))
rev_8 = Reverse(Vector=Z_32)

# ----
# Gravity
Z_33 = UnitZ(Factor=Slider(1, range=0..10))
rev_9 = Reverse(Vector=Z_33)

dimentions_cm_25 = Panel("10")
dimentions_cm_26 = Panel("15")
dimentions_cm_27 = Panel("15")
dimentions_cm_28 = Panel("30")
dimentions_cm_29 = Panel("55")

# ----
# list of cross sections
# list of cross sections
dimentions_cm_30 = Panel("30")
dimentions_cm_31 = Panel("10")
height_cm_7 = Panel("5")
cross_section_19 = CrossSectionKaramba3D(
    FamilyNameOfCrossSection="DefaultCroSec",
    ElementIdentifier="Beam",
    Material=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,
    Height_cm=dimentions_cm_30,
    UpperFlangeWidth_cm=dimentions_cm_25,
    LowerFlangeWidth_cm=dimentions_cm_25,
    mode="Trapezoid")
cross_section_20 = CrossSectionKaramba3D(
    FamilyNameOfCrossSection="DefaultCroSec",
    ElementIdentifier="Column",
    Material=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,
    Height_cm=dimentions_cm_28,
    UpperFlangeWidth_cm=dimentions_cm_31,
    LowerFlangeWidth_cm=dimentions_cm_31,
    mode="Trapezoid")
cross_section_21 = CrossSectionKaramba3D(
    FamilyNameOfCrossSection="DefaultCroSec",
    ElementIdentifier="Slab",
    Material=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,
    Height_cm=height_cm_7,
    mode="Shell - Const")
merge_19 = Merge(Data1=cross_section_19, Data2=cross_section_20, Data3=cross_section_21)  # -> flatten(Result)

dimentions_cm_32 = Panel("45")

# ----
# list of cross sections
# list of cross sections
dimentions_cm_33 = Panel("55")
dimentions_cm_34 = Panel("10")
height_cm_8 = Panel("7")
cross_section_22 = CrossSectionKaramba3D(
    FamilyNameOfCrossSection="DefaultCroSec",
    ElementIdentifier="Beam",
    Material=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,
    Height_cm=dimentions_cm_33,
    UpperFlangeWidth_cm=dimentions_cm_26,
    LowerFlangeWidth_cm=dimentions_cm_26,
    mode="Trapezoid")
cross_section_23 = CrossSectionKaramba3D(
    FamilyNameOfCrossSection="DefaultCroSec",
    ElementIdentifier="Column",
    Material=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,
    Height_cm=dimentions_cm_29,
    UpperFlangeWidth_cm=dimentions_cm_34,
    LowerFlangeWidth_cm=dimentions_cm_34,
    mode="Trapezoid")
cross_section_24 = CrossSectionKaramba3D(
    FamilyNameOfCrossSection="DefaultCroSec",
    ElementIdentifier="Slab",
    Material=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,
    Height_cm=height_cm_8,
    mode="Shell - Const")
merge_20 = Merge(Data1=cross_section_22, Data2=cross_section_23, Data3=cross_section_24)  # -> flatten(Result)

# ----
# list of cross sections
# list of cross sections
dimentions_cm_35 = Panel("45")
dimentions_cm_36 = Panel("30")
height_cm_9 = Panel("10")
cross_section_25 = CrossSectionKaramba3D(
    FamilyNameOfCrossSection="DefaultCroSec",
    ElementIdentifier="Beam",
    Material=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,
    Height_cm=dimentions_cm_35,
    UpperFlangeWidth_cm=dimentions_cm_27,
    LowerFlangeWidth_cm=dimentions_cm_27,
    mode="Trapezoid")
cross_section_26 = CrossSectionKaramba3D(
    FamilyNameOfCrossSection="DefaultCroSec",
    ElementIdentifier="Column",
    Material=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,
    Height_cm=dimentions_cm_32,
    UpperFlangeWidth_cm=dimentions_cm_36,
    LowerFlangeWidth_cm=dimentions_cm_36,
    mode="Trapezoid")
cross_section_27 = CrossSectionKaramba3D(
    FamilyNameOfCrossSection="DefaultCroSec",
    ElementIdentifier="Slab",
    Material=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,
    Height_cm=height_cm_9,
    mode="Shell - Const")
merge_21 = Merge(Data1=cross_section_25, Data2=cross_section_26, Data3=cross_section_27)  # -> flatten(Result)

loads_10 = LoadsKaramba3D(Vector=rev_7, LCase="0", mode="Gravity")
loads_11 = LoadsKaramba3D(Vector=rev_8, LCase="0", mode="Gravity")
loads_12 = LoadsKaramba3D(Vector=rev_9, LCase="0", mode="Gravity")
loads_13 = LoadsKaramba3D(Vector=Z_26, Mesh=move_22.Geometry, LCase="1", mode="MeshLoad -Const.", menu=[buttons(off, on, off), buttons(on, on)])
loads_14 = LoadsKaramba3D(Vector=Z_28, Mesh=move_23.Geometry, LCase="1", mode="MeshLoad -Const.", menu=[buttons(off, on, off), buttons(on, on)])
loads_15 = LoadsKaramba3D(Vector=Z_30, Mesh=move_24.Geometry, LCase="1", mode="MeshLoad -Const.", menu=[buttons(off, on, off), buttons(on, on)])
pt_4 = Point(sdivide_4.Points)
pt_5 = Point(sdivide_5.Points)
pt_6 = Point(sdivide_6.Points)

# ----
# supports
xy_4 = XYPlane(Origin=Point(0, 0, 0))
supp_4 = SupportKaramba3D(PosInd=flatten(pt_4), PlaneOfReference=xy_4, menu=[buttons(on, on, on, on, on, on)])

# ----
# supports
xy_5 = XYPlane(Origin=Point(0, 0, 0))
supp_5 = SupportKaramba3D(PosInd=flatten(pt_5), PlaneOfReference=xy_5, menu=[buttons(on, on, on, on, on, on)])

# ----
# supports
xy_6 = XYPlane(Origin=Point(0, 0, 0))
supp_6 = SupportKaramba3D(PosInd=flatten(pt_6), PlaneOfReference=xy_6, menu=[buttons(on, on, on, on, on, on)])

# ----
# Loads
# list of loads
merge_22 = Merge(Data1=loads_10, Data2=loads_13)  # -> flatten(Result)

# ----
# Loads
# list of loads
merge_23 = Merge(Data1=loads_11, Data2=loads_14)  # -> flatten(Result)

# ----
# Loads
# list of loads
merge_24 = Merge(Data1=loads_12, Data2=loads_15)  # -> flatten(Result)

matselect_7 = MaterialSelectionKaramba3D(menu=[dropdown(1), dropdown(1)])
matselect_8 = MaterialSelectionKaramba3D(menu=[dropdown(1), dropdown(1)])
matselect_9 = MaterialSelectionKaramba3D(menu=[dropdown(1), dropdown(2)])
assemble_4 = AssembleModelKaramba3D(
    Elem=flatten(merge_16),
    Support=flatten(supp_4),
    Load=merge_22,
    CrossSection=merge_19,
    Material=matselect_7,
    LimitDistance_m=0.005)  # -> Model, Info, Mass_kg, CenterOfGravity, LoadCaseNames
assemble_5 = AssembleModelKaramba3D(
    Elem=flatten(merge_17),
    Support=flatten(supp_5),
    Load=merge_23,
    CrossSection=merge_20,
    Material=matselect_8,
    LimitDistance_m=0.005)  # -> Model, Info, Mass_kg, CenterOfGravity, LoadCaseNames
assemble_6 = AssembleModelKaramba3D(
    Elem=flatten(merge_18),
    Support=flatten(supp_6),
    Load=merge_24,
    CrossSection=merge_21,
    Material=matselect_9,
    LimitDistance_m=0.005)  # -> Model, Info, Mass_kg, CenterOfGravity, LoadCaseNames
panel_22 = Panel(assemble_4.Mass_kg)
panel_23 = Panel(assemble_5.Mass_kg)
panel_24 = Panel(assemble_6.Mass_kg)
dam_4 = DataDam(DataA=assemble_4.Model, BufferDelay=10000000, BufferMode=0)
dam_5 = DataDam(DataA=assemble_5.Model, BufferDelay=10000000, BufferMode=0)
dam_6 = DataDam(DataA=assemble_6.Model, BufferDelay=10000000, BufferMode=0)
nvibes_4 = NaturalVibrationsKaramba3D(Model=dam_4, FromIndex=1, NumberOfModes=Slider(1, range=0..10), MaximumNumberOfIterations=30, Epsilon=1e-05)  # -> ModelWithVibrationModesAsLoadCaseResults, flatten(NaturalFrequencies_Hz), ModalMass_kg, ParticipationFactorInGlobalXYAndZDirection
nvibes_5 = NaturalVibrationsKaramba3D(Model=dam_5, FromIndex=1, NumberOfModes=Slider(1, range=0..10), MaximumNumberOfIterations=30, Epsilon=1e-05)  # -> ModelWithVibrationModesAsLoadCaseResults, flatten(NaturalFrequencies_Hz), ModalMass_kg, expr("abs(x)", ParticipationFactorInGlobalXYAndZDirection)
nvibes_6 = NaturalVibrationsKaramba3D(Model=dam_6, FromIndex=1, NumberOfModes=Slider(1, range=0..10), MaximumNumberOfIterations=30, Epsilon=1e-05)  # -> ModelWithVibrationModesAsLoadCaseResults, flatten(NaturalFrequencies_Hz), ModalMass_kg, expr("abs(x)", ParticipationFactorInGlobalXYAndZDirection)
yz_7 = YZPlane(Origin=Point(0, 0, 0))
yz_8 = YZPlane(Origin=Point(0, 0, 0))
yz_9 = YZPlane(Origin=Point(0, 0, 0))
participation_factor_4 = Panel(nvibes_5.ParticipationFactorInGlobalXYAndZDirection)
natural_frequency_4 = Panel(nvibes_5.NaturalFrequencies_Hz)
participation_factor_5 = Panel(nvibes_4.ParticipationFactorInGlobalXYAndZDirection)
natural_frequency_5 = Panel(nvibes_4.NaturalFrequencies_Hz)
participation_factor_6 = Panel(nvibes_6.ParticipationFactorInGlobalXYAndZDirection)
natural_frequency_6 = Panel(nvibes_6.NaturalFrequencies_Hz)
# Run the Data Dam
modelview_4 = ModelViewKaramba3D(Model=nvibes_4.ModelWithVibrationModesAsLoadCaseResults, DisplacementDirection=yz_7, ResultFactors=1, ResultCase=-1)  # -> Model, DeformedMesh, DeformedAxes, DeformedModel
# Run the Data Dam
modelview_5 = ModelViewKaramba3D(Model=nvibes_5.ModelWithVibrationModesAsLoadCaseResults, DisplacementDirection=yz_8, ResultFactors=1, ResultCase=-1)  # -> Model, DeformedMesh, DeformedAxes, DeformedModel
# Run the Data Dam
modelview_6 = ModelViewKaramba3D(Model=nvibes_6.ModelWithVibrationModesAsLoadCaseResults, DisplacementDirection=yz_9, ResultFactors=1, ResultCase=-1)  # -> Model, DeformedMesh, DeformedAxes, DeformedModel
shellview_4 = ShellViewKaramba3D(Model=modelview_4.Model, IndexOfLayer=0)  # -> Model, MeshesOfRenderedShells, LegendColors, LegendTags
shellview_5 = ShellViewKaramba3D(Model=modelview_5.Model, IndexOfLayer=0)  # -> Model, MeshesOfRenderedShells, LegendColors, LegendTags
beamview_4 = BeamViewKaramba3D(Model=modelview_4.Model)  # -> Model, MeshesOfRenderedBeams, DeformedBeamAxes, LegendColors, LegendTags
shellview_6 = ShellViewKaramba3D(Model=modelview_6.Model, IndexOfLayer=0)  # -> Model, MeshesOfRenderedShells, LegendColors, LegendTags
beamview_5 = BeamViewKaramba3D(Model=modelview_5.Model)  # -> Model, MeshesOfRenderedBeams, DeformedBeamAxes, LegendColors, LegendTags
beamview_6 = BeamViewKaramba3D(Model=modelview_6.Model)  # -> Model, MeshesOfRenderedBeams, DeformedBeamAxes, LegendColors, LegendTags
legend_7 = Legend(Colour=shellview_4.LegendColors, Tags=shellview_4.LegendTags, LegendType=1)
legend_8 = Legend(Colour=shellview_5.LegendColors, Tags=shellview_5.LegendTags, LegendType=1)
legend_9 = Legend(Colour=shellview_6.LegendColors, Tags=shellview_6.LegendTags, LegendType=1)
legend_10 = Legend(Colour=beamview_4.LegendColors, Tags=beamview_4.LegendTags, LegendType=1)
legend_11 = Legend(Colour=beamview_5.LegendColors, Tags=beamview_5.LegendTags, LegendType=1)
legend_12 = Legend(Colour=beamview_6.LegendColors, Tags=beamview_6.LegendTags, LegendType=1)
crv_7 = Curve(modelview_4.DeformedAxes)
crv_8 = Curve(modelview_5.DeformedAxes)
crv_9 = Curve(modelview_6.DeformedAxes)
item_4 = ListItem(List=crv_7, Index=Slider(122, range=0..195), Wrap=True)
item_5 = ListItem(List=crv_8, Index=Slider(198, range=0..363), Wrap=True)
item_6 = ListItem(List=crv_9, Index=Slider(365, range=0..390), Wrap=True)
crv_10 = Curve(item_4)
crv_11 = Curve(item_5)
crv_12 = Curve(item_6)
join_7 = JoinCurves(Curves=crv_10, Preserve=False)
join_8 = JoinCurves(Curves=crv_11, Preserve=False)
join_9 = JoinCurves(Curves=crv_12, Preserve=False)
divide_10 = DivideCurve(Curve=join_7, Count=Slider(3, range=0..10), Kinks=False)  # -> expr("round(x,3)", reverse(flatten(Points))), Tangents, Parameters
divide_11 = DivideCurve(Curve=join_8, Count=Slider(3, range=0..10), Kinks=False)  # -> expr("round(x,3)", reverse(flatten(Points))), Tangents, Parameters
divide_12 = DivideCurve(Curve=join_9, Count=Slider(6, range=0..10), Kinks=False)  # -> expr("round(x,3)", reverse(flatten(Points))), Tangents, Parameters
expression_13 = Expression(x=divide_10.Points, Expression="abs(x)")
expression_14 = Expression(x=divide_11.Points, Expression="abs(x)")
expression_15 = Expression(x=divide_12.Points, Expression="abs(x)")
pdecon_4 = Deconstruct(Point=expression_13)  # -> XComponent, YComponent, ZComponent
pdecon_5 = Deconstruct(Point=expression_14)  # -> XComponent, YComponent, ZComponent
pdecon_6 = Deconstruct(Point=expression_15)  # -> XComponent, YComponent, ZComponent
ma_7 = MassAddition(Input=pdecon_4.YComponent)  # -> Result, PartialResults
ma_8 = MassAddition(Input=pdecon_5.YComponent)  # -> Result, PartialResults
# Extraction of displacement in a plane
ma_9 = MassAddition(Input=pdecon_4.XComponent)  # -> Result, PartialResults
ma_10 = MassAddition(Input=pdecon_6.YComponent)  # -> Result, PartialResults
# Extraction of displacement in a plane
ma_11 = MassAddition(Input=pdecon_5.XComponent)  # -> Result, PartialResults
# Extraction of displacement in a plane
ma_12 = MassAddition(Input=pdecon_6.XComponent)  # -> Result, PartialResults
expression_16 = Expression(y=ma_7.Result, Expression="if(y=0, false, true)")
expression_17 = Expression(y=ma_8.Result, Expression="if(y=0, false, true)")
expression_18 = Expression(y=ma_10.Result, Expression="if(y=0, false, true)")
expression_19 = Expression(x=pdecon_4.XComponent, y=ma_9.Result, Expression="if(y=0, false, true)")
expression_20 = Expression(x=pdecon_5.XComponent, y=ma_11.Result, Expression="if(y=0, false, true)")
expression_21 = Expression(x=pdecon_6.XComponent, y=ma_12.Result, Expression="if(y=0, false, true)")
expression_22 = Expression(x=pdecon_4.ZComponent, Expression="ROUND(X,0)")
expression_23 = Expression(x=pdecon_5.ZComponent, Expression="ROUND(X,0)")
expression_24 = Expression(x=pdecon_6.ZComponent, Expression="ROUND(X,0)")
cull_7 = CullPattern(List=pdecon_4.YComponent, CullPattern=expression_16)
cull_8 = CullPattern(List=pdecon_5.YComponent, CullPattern=expression_17)
cull_9 = CullPattern(List=pdecon_6.YComponent, CullPattern=expression_18)
cull_10 = CullPattern(List=pdecon_4.XComponent, CullPattern=expression_19)
cull_11 = CullPattern(List=pdecon_5.XComponent, CullPattern=expression_20)
cull_12 = CullPattern(List=pdecon_6.XComponent, CullPattern=expression_21)
merge_25 = Merge(Data1=graft(cull_10), Data2=graft(cull_7), Data3=graft(expression_22))
merge_26 = Merge(Data1=graft(cull_11), Data2=graft(cull_8), Data3=graft(expression_23))
merge_27 = Merge(Data1=graft(cull_12), Data2=graft(cull_9), Data3=graft(expression_24))
join_10 = TextJoin(Text=merge_25, Join=",")  # -> flatten(Result)
join_11 = TextJoin(Text=merge_26, Join=",")  # -> flatten(Result)
# Displacement Values
join_12 = TextJoin(Text=merge_27, Join=",")  # -> flatten(Result)
# Displacement Values
panel_25 = Panel(join_10)
# Displacement Values
panel_26 = Panel(join_11)
panel_27 = Panel(join_12)

# ----
# Slab Creation
# Structural elements
# Input
# Z-Direction
# X-Direction
# Y-Direction
# Beam Creation
distance_between_columns_13 = Slider(2, range=0..600)
number_of_bays_x_direction_7 = Slider(4, range=0..10)
distance_between_floors_7 = Slider(3, range=0..300)
number_of_floors_7 = Slider(4, range=0..10)
number_of_bays_y_direction_7 = Slider(4, range=0..10)
distance_between_columns_14 = Slider(2, range=0..600)
multiplication_13 = Multiplication(A=number_of_bays_y_direction_7, B=distance_between_columns_14)
series_7 = Series(Start=0, Step=distance_between_floors_7, Count=number_of_floors_7)
multiplication_14 = Multiplication(A=number_of_bays_x_direction_7, B=distance_between_columns_13)
planesrf_7 = PlaneSurface(Plane=PlaneXY(0, 0, 0), XSize=multiplication_14, YSize=multiplication_13)
sdivide_7 = DivideSurface(Surface=planesrf_7, UCount=number_of_bays_x_direction_7, VCount=number_of_bays_y_direction_7)  # -> flatten(Points), Normals, Parameters
flip_7 = FlipMatrix(Data=sdivide_7.Parameters)
pline_19 = PolyLine(Vertices=sdivide_7.Parameters, Closed=False)
pline_20 = PolyLine(Vertices=flip_7, Closed=False)
explode_18 = Explode(Curve=[pline_19, pline_20], Recursive=True)  # -> Segments, Vertices
Z_34 = UnitZ(Factor=series_7)
# Structural elements
number_slider_8 = Slider(0, range=0..1)
len_7 = Length(Curve=explode_18.Segments)
move_25 = Move(Geometry=planesrf_7, Motion=Z_34)  # -> Geometry, Transform
division_7 = Division(A=len_7, B=Slider(2, range=0..10))
move_26 = Move(Geometry=sdivide_7.Points, Motion=graft(Z_34))  # -> Geometry, Transform
divide_13 = DivideCurve(Curve=explode_18.Segments, Count=division_7, Kinks=False)  # -> Points, Tangents, Parameters
ln_7 = Line(StartPoint=move_26.Geometry, EndPoint=sdivide_7.Points)
cull_i_13 = CullIndex(List=move_25.Geometry, Indices=number_slider_8, Wrap=True)
pline_21 = PolyLine(Vertices=divide_13.Points, Closed=False)
move_27 = Move(Geometry=pline_21, Motion=Z_34)  # -> Geometry, Transform
mesh_uv_7 = MeshSurface(Surface=cull_i_13, UCount=5, VCount=5, Overhang=True, Equalize=False)  # -> flatten(Mesh)
cull_i_14 = CullIndex(List=move_27.Geometry, Indices=Slider(0, range=0..1), Wrap=True)
explode_19 = Explode(Curve=cull_i_14, Recursive=distance_between_columns_13)  # -> Segments, Vertices
linetobeam_13 = LineToBeamKaramba3D(
    Line=explode_19.Segments,
    Identifier="Beam",
    New=True,
    Remove=True,
    LimitDistance_m=0.005,
    Bending=True,
    SetBucklingLength=True,
    ToPolylineMaxAngle=0.03,
    ToPolylineTolerance=0.01,
    ToPolylineMaxEdgeLength=0.25)  # -> Element, Points, Info

# ----
# Mesh Load
mesh_7 = Mesh(flatten(mesh_uv_7))
area_7 = Area(Geometry=mesh_7)  # -> Area, Centroid
Z_35 = UnitZ(Factor="1")
scale_7 = Scale(Geometry=mesh_7, Center=area_7.Centroid, Factor="1.8")  # -> flatten(Geometry), Transform
load_kn_m2_7 = Panel("-1")
Z_36 = UnitZ(Factor=load_kn_m2_7)
move_28 = Move(Geometry=scale_7.Geometry, Motion=Z_35)  # -> Geometry, Transform

area_8 = MeshArea(Mesh=move_25.Geometry)  # -> Area, Centroid
cull_i_15 = CullIndex(List=area_8.Centroid, Indices=number_slider_4, Wrap=True)
cps = ClosestPoints(Point=cull_i_15, Cloud=flatten(move_26.Geometry), Count=5)  # -> ClosestPoint, CPIndex, Distance
cull_i_16 = CullIndex(List=cps.ClosestPoint, Indices="0", Wrap=True)
loads_16 = LoadsKaramba3D(Vector=Z_36, Mesh=move_28.Geometry, LCase="1", mode="MeshLoad -Const.", menu=[buttons(off, on, off), buttons(on, on)])
item_7 = ListItem(List=cull_i_16, Index=panel_7, Wrap=True)
item_8 = ListItem(List=cull_i_16, Index=panel_8, Wrap=True)

# ----
# Loads
# list of loads
merge_28 = Merge(Data1=loads_7, Data2=loads_16)  # -> flatten(Result)

pl = ConstructPlane(Origin=item_7, XAxis=Y, YAxis=Z_16)
pl_2 = ConstructPlane(Origin=item_8, XAxis=X, YAxis=Z_17)
vec = VectorXYZ(XComponent=0, YComponent=0, ZComponent=distance_between_floors_7)  # -> Vector, Length
item_9 = ListItem(List=cps.ClosestPoint, Index="0", Wrap=True)
scale_8 = Scale(Geometry=[pl, pl_2], Center=item_9, Factor="0.5")  # -> Geometry, Transform
planesrf_8 = PlaneSurface(Plane=scale_8.Geometry, XSize="-1 to 1", YSize=vec.Vector)  # -> flatten(Plane)
demesh = DeconstructMesh(Mesh=planesrf_8)  # -> Vertices, Faces, Colours, Normals
# Run the Data Dam
item_10 = ListItem(List=flatten(demesh.Vertices), Index=panel_13, Wrap=True)
pt_7 = Point([sdivide_7.Points, item_10])
rdpoints = RemoveDuplicatePointsKaramba3D(Point=pt_7, LimitDistance=0.005)  # -> OutPoint, Info, Indexes

# ----
# supports
xy_7 = XYPlane(Origin=Point(0, 0, 0))
supp_7 = SupportKaramba3D(PosInd=flatten(rdpoints.OutPoint), PlaneOfReference=xy_7, menu=[buttons(on, on, on, on, on, on)])

item_11 = ListItem(List=flatten(demesh.Vertices), Index=panel_16, Wrap=True)
ln_8 = Line(StartPoint=item_11, EndPoint=item_10)

linetobeam_14 = LineToBeamKaramba3D(
    Line=[ln_7, ln_8],
    Identifier="Column",
    New=True,
    Remove=True,
    LimitDistance_m=0.005,
    Bending=True,
    SetBucklingLength=True,
    ToPolylineMaxAngle=0.03,
    ToPolylineTolerance=0.01,
    ToPolylineMaxEdgeLength=0.25)  # -> Element, Points, Info
meshtoshell_7 = MeshToShellKaramba3D(Mesh=[mesh_uv_7, planesrf_8], Identifier="Slab", LimitDistance_m=0.005)  # -> Element, Points, Info
merge_29 = Merge(Data1=meshtoshell_7.Element, Data2=linetobeam_14.Element, Data3=linetobeam_13.Element)

assemble_7 = AssembleModelKaramba3D(
    Elem=flatten(merge_29),
    Support=flatten(supp_7),
    Load=merge_28,
    CrossSection=merge_13,
    Material=matselect_4,
    LimitDistance_m=0.005)  # -> Model, Info, Mass_kg, CenterOfGravity, LoadCaseNames
panel_28 = Panel(assemble_7.Mass_kg)
dam_7 = DataDam(DataA=assemble_7.Model, BufferDelay=10000000, BufferMode=0)
nvibes_7 = NaturalVibrationsKaramba3D(Model=dam_7, FromIndex=1, NumberOfModes=Slider(1, range=0..10), MaximumNumberOfIterations=30, Epsilon=1e-05)  # -> ModelWithVibrationModesAsLoadCaseResults, flatten(NaturalFrequencies_Hz), ModalMass_kg, expr("abs(x)", ParticipationFactorInGlobalXYAndZDirection)
participation_factor_7 = Panel(nvibes_7.ParticipationFactorInGlobalXYAndZDirection)
natural_frequency_7 = Panel(nvibes_7.NaturalFrequencies_Hz)
modelview_7 = ModelViewKaramba3D(Model=nvibes_7.ModelWithVibrationModesAsLoadCaseResults, DisplacementDirection=yz_5, ResultFactors=1, ResultCase=-1)  # -> Model, DeformedMesh, DeformedAxes, DeformedModel
shellview_7 = ShellViewKaramba3D(Model=modelview_7.Model, IndexOfLayer=0)  # -> Model, MeshesOfRenderedShells, LegendColors, LegendTags
beamview_7 = BeamViewKaramba3D(Model=modelview_7.Model)  # -> Model, MeshesOfRenderedBeams, DeformedBeamAxes, LegendColors, LegendTags
legend_13 = Legend(Colour=shellview_7.LegendColors, Tags=shellview_7.LegendTags, LegendType=1)
legend_14 = Legend(Colour=beamview_7.LegendColors, Tags=beamview_7.LegendTags, LegendType=1)
crv_13 = Curve(modelview_7.DeformedAxes)
item_12 = ListItem(List=crv_13, Index=Slider(126, range=0..199), Wrap=True)
crv_14 = Curve(item_12)
join_13 = JoinCurves(Curves=crv_14, Preserve=False)
divide_14 = DivideCurve(Curve=join_13, Count=Slider(3, range=0..10), Kinks=False)  # -> expr("round(x,3)", reverse(flatten(Points))), Tangents, Parameters
expression_25 = Expression(x=divide_14.Points, Expression="abs(x)")
pdecon_7 = Deconstruct(Point=expression_25)  # -> XComponent, YComponent, ZComponent
ma_13 = MassAddition(Input=pdecon_7.YComponent)  # -> Result, PartialResults
# Extraction of displacement in a plane
ma_14 = MassAddition(Input=pdecon_7.XComponent)  # -> Result, PartialResults
expression_26 = Expression(y=ma_13.Result, Expression="if(y=0, false, true)")
expression_27 = Expression(x=pdecon_7.XComponent, y=ma_14.Result, Expression="if(y=0, false, true)")
expression_28 = Expression(x=pdecon_7.ZComponent, Expression="ROUND(X,0)")
cull_13 = CullPattern(List=pdecon_7.YComponent, CullPattern=expression_26)
cull_14 = CullPattern(List=pdecon_7.XComponent, CullPattern=expression_27)
merge_30 = Merge(Data1=graft(cull_14), Data2=graft(cull_13), Data3=graft(expression_28))
join_14 = TextJoin(Text=merge_30, Join=",")  # -> flatten(Result)
# Displacement Values
panel_29 = Panel(join_14)

# ----
# Slab Creation
# Structural elements
# Input
# Z-Direction
# X-Direction
# Y-Direction
# Beam Creation
distance_between_columns_15 = Slider(2, range=0..600)
number_of_bays_x_direction_8 = Slider(8, range=0..10)
distance_between_floors_8 = Slider(3, range=0..300)
number_of_floors_8 = Slider(4, range=0..10)
number_of_bays_y_direction_8 = Slider(4, range=0..10)
distance_between_columns_16 = Slider(2, range=0..600)
multiplication_15 = Multiplication(A=number_of_bays_y_direction_8, B=distance_between_columns_16)
series_8 = Series(Start=0, Step=distance_between_floors_8, Count=number_of_floors_8)
multiplication_16 = Multiplication(A=number_of_bays_x_direction_8, B=distance_between_columns_15)
planesrf_9 = PlaneSurface(Plane=PlaneXY(0, 0, 0), XSize=multiplication_16, YSize=multiplication_15)
sdivide_8 = DivideSurface(Surface=planesrf_9, UCount=number_of_bays_x_direction_8, VCount=number_of_bays_y_direction_8)  # -> flatten(Points), Normals, Parameters
flip_8 = FlipMatrix(Data=sdivide_8.Parameters)
pline_22 = PolyLine(Vertices=sdivide_8.Parameters, Closed=False)
pline_23 = PolyLine(Vertices=flip_8, Closed=False)
explode_20 = Explode(Curve=[pline_22, pline_23], Recursive=True)  # -> Segments, Vertices
Z_37 = UnitZ(Factor=series_8)
# Structural elements
number_slider_9 = Slider(0, range=0..1)
len_8 = Length(Curve=explode_20.Segments)
move_29 = Move(Geometry=planesrf_9, Motion=Z_37)  # -> Geometry, Transform
division_8 = Division(A=len_8, B=Slider(2, range=0..10))
move_30 = Move(Geometry=sdivide_8.Points, Motion=graft(Z_37))  # -> Geometry, Transform
divide_15 = DivideCurve(Curve=explode_20.Segments, Count=division_8, Kinks=False)  # -> Points, Tangents, Parameters
ln_9 = Line(StartPoint=move_30.Geometry, EndPoint=sdivide_8.Points)
cull_i_17 = CullIndex(List=move_29.Geometry, Indices=number_slider_9, Wrap=True)
pline_24 = PolyLine(Vertices=divide_15.Points, Closed=False)
move_31 = Move(Geometry=pline_24, Motion=Z_37)  # -> Geometry, Transform
mesh_uv_8 = MeshSurface(Surface=cull_i_17, UCount=5, VCount=5, Overhang=True, Equalize=False)  # -> flatten(Mesh)
cull_i_18 = CullIndex(List=move_31.Geometry, Indices=Slider(0, range=0..1), Wrap=True)
explode_21 = Explode(Curve=cull_i_18, Recursive=distance_between_columns_15)  # -> Segments, Vertices
linetobeam_15 = LineToBeamKaramba3D(
    Line=explode_21.Segments,
    Identifier="Beam",
    New=True,
    Remove=True,
    LimitDistance_m=0.005,
    Bending=True,
    SetBucklingLength=True,
    ToPolylineMaxAngle=0.03,
    ToPolylineTolerance=0.01,
    ToPolylineMaxEdgeLength=0.25)  # -> Element, Points, Info

# ----
# Mesh Load
mesh_8 = Mesh(flatten(mesh_uv_8))
area_9 = Area(Geometry=mesh_8)  # -> Area, Centroid
Z_38 = UnitZ(Factor="1")
scale_9 = Scale(Geometry=mesh_8, Center=area_9.Centroid, Factor="1.8")  # -> flatten(Geometry), Transform
load_kn_m2_8 = Panel("-1")
Z_39 = UnitZ(Factor=load_kn_m2_8)
move_32 = Move(Geometry=scale_9.Geometry, Motion=Z_38)  # -> Geometry, Transform

area_10 = MeshArea(Mesh=move_29.Geometry)  # -> Area, Centroid
cull_i_19 = CullIndex(List=area_10.Centroid, Indices=Slider(3, range=0..10), Wrap=True)
cps_2 = ClosestPoints(Point=cull_i_19, Cloud=flatten(move_30.Geometry), Count=5)  # -> ClosestPoint, CPIndex, Distance
cull_i_20 = CullIndex(List=cps_2.ClosestPoint, Indices="0", Wrap=True)
loads_17 = LoadsKaramba3D(Vector=Z_39, Mesh=move_32.Geometry, LCase="1", mode="MeshLoad -Const.", menu=[buttons(off, on, off), buttons(on, on)])
item_13 = ListItem(List=cull_i_20, Index=panel_9, Wrap=True)
item_14 = ListItem(List=cull_i_20, Index=panel_10, Wrap=True)

# ----
# Loads
# list of loads
merge_31 = Merge(Data1=loads_8, Data2=loads_17)  # -> flatten(Result)

pl_3 = ConstructPlane(Origin=item_13, XAxis=Y_2, YAxis=Z_18)
pl_4 = ConstructPlane(Origin=item_14, XAxis=X_2, YAxis=Z_19)
vec_2 = VectorXYZ(XComponent=0, YComponent=0, ZComponent=distance_between_floors_8)  # -> Vector, Length
item_15 = ListItem(List=cps_2.ClosestPoint, Index="0", Wrap=True)
scale_10 = Scale(Geometry=[pl_3, pl_4], Center=item_15, Factor="0.5")  # -> Geometry, Transform
planesrf_10 = PlaneSurface(Plane=scale_10.Geometry, XSize="-1 to 1", YSize=vec_2.Vector)  # -> flatten(Plane)
demesh_2 = DeconstructMesh(Mesh=planesrf_10)  # -> Vertices, Faces, Colours, Normals
# Run the Data Dam
item_16 = ListItem(List=flatten(demesh_2.Vertices), Index=panel_14, Wrap=True)
pt_8 = Point([sdivide_8.Points, item_16])
rdpoints_2 = RemoveDuplicatePointsKaramba3D(Point=pt_8, LimitDistance=0.005)  # -> OutPoint, Info, Indexes

# ----
# supports
xy_8 = XYPlane(Origin=Point(0, 0, 0))
supp_8 = SupportKaramba3D(PosInd=flatten(rdpoints_2.OutPoint), PlaneOfReference=xy_8, menu=[buttons(on, on, on, on, on, on)])

item_17 = ListItem(List=flatten(demesh_2.Vertices), Index=panel_17, Wrap=True)
ln_10 = Line(StartPoint=item_17, EndPoint=item_16)

linetobeam_16 = LineToBeamKaramba3D(
    Line=[ln_9, ln_10],
    Identifier="Column",
    New=True,
    Remove=True,
    LimitDistance_m=0.005,
    Bending=True,
    SetBucklingLength=True,
    ToPolylineMaxAngle=0.03,
    ToPolylineTolerance=0.01,
    ToPolylineMaxEdgeLength=0.25)  # -> Element, Points, Info
meshtoshell_8 = MeshToShellKaramba3D(Mesh=[mesh_uv_8, planesrf_10], Identifier="Slab", LimitDistance_m=0.005)  # -> Element, Points, Info
merge_32 = Merge(Data1=meshtoshell_8.Element, Data2=linetobeam_16.Element, Data3=linetobeam_15.Element)

assemble_8 = AssembleModelKaramba3D(
    Elem=flatten(merge_32),
    Support=flatten(supp_8),
    Load=merge_31,
    CrossSection=merge_14,
    Material=matselect_5,
    LimitDistance_m=0.005)  # -> Model, Info, Mass_kg, CenterOfGravity, LoadCaseNames
panel_30 = Panel(assemble_8.Mass_kg)
dam_8 = DataDam(DataA=assemble_8.Model, BufferDelay=10000000, BufferMode=0)
nvibes_8 = NaturalVibrationsKaramba3D(Model=dam_8, FromIndex=1, NumberOfModes=Slider(1, range=0..10), MaximumNumberOfIterations=30, Epsilon=1e-05)  # -> ModelWithVibrationModesAsLoadCaseResults, flatten(NaturalFrequencies_Hz), ModalMass_kg, expr("abs(x)", ParticipationFactorInGlobalXYAndZDirection)
participation_factor_8 = Panel(nvibes_8.ParticipationFactorInGlobalXYAndZDirection)
natural_frequency_8 = Panel(nvibes_8.NaturalFrequencies_Hz)
modelview_8 = ModelViewKaramba3D(Model=nvibes_8.ModelWithVibrationModesAsLoadCaseResults, DisplacementDirection=yz_4, ResultFactors=1, ResultCase=-1)  # -> Model, DeformedMesh, DeformedAxes, DeformedModel
shellview_8 = ShellViewKaramba3D(Model=modelview_8.Model, IndexOfLayer=0)  # -> Model, MeshesOfRenderedShells, LegendColors, LegendTags
beamview_8 = BeamViewKaramba3D(Model=modelview_8.Model)  # -> Model, MeshesOfRenderedBeams, DeformedBeamAxes, LegendColors, LegendTags
legend_15 = Legend(Colour=shellview_8.LegendColors, Tags=shellview_8.LegendTags, LegendType=1)
legend_16 = Legend(Colour=beamview_8.LegendColors, Tags=beamview_8.LegendTags, LegendType=1)
crv_15 = Curve(modelview_8.DeformedAxes)
item_18 = ListItem(List=crv_15, Index=Slider(202, range=0..367), Wrap=True)
crv_16 = Curve(item_18)
join_15 = JoinCurves(Curves=crv_16, Preserve=False)
divide_16 = DivideCurve(Curve=join_15, Count=Slider(3, range=0..10), Kinks=False)  # -> expr("round(x,3)", reverse(flatten(Points))), Tangents, Parameters
expression_29 = Expression(x=divide_16.Points, Expression="abs(x)")
pdecon_8 = Deconstruct(Point=expression_29)  # -> XComponent, YComponent, ZComponent
ma_15 = MassAddition(Input=pdecon_8.YComponent)  # -> Result, PartialResults
# Extraction of displacement in a plane
ma_16 = MassAddition(Input=pdecon_8.XComponent)  # -> Result, PartialResults
expression_30 = Expression(y=ma_15.Result, Expression="if(y=0, false, true)")
expression_31 = Expression(x=pdecon_8.XComponent, y=ma_16.Result, Expression="if(y=0, false, true)")
expression_32 = Expression(x=pdecon_8.ZComponent, Expression="ROUND(X,0)")
cull_15 = CullPattern(List=pdecon_8.YComponent, CullPattern=expression_30)
cull_16 = CullPattern(List=pdecon_8.XComponent, CullPattern=expression_31)
merge_33 = Merge(Data1=graft(cull_16), Data2=graft(cull_15), Data3=graft(expression_32))
join_16 = TextJoin(Text=merge_33, Join=",")  # -> flatten(Result)
# Displacement Values
panel_31 = Panel(join_16)

# ----
# Slab Creation
# Structural elements
# Input
# Z-Direction
# X-Direction
# Y-Direction
# Beam Creation
distance_between_columns_17 = Slider(2, range=0..600)
number_of_bays_x_direction_9 = Slider(4, range=0..10)
distance_between_floors_9 = Slider(3, range=0..300)
number_of_floors_9 = Slider(7, range=0..10)
number_of_bays_y_direction_9 = Slider(4, range=0..10)
distance_between_columns_18 = Slider(2, range=0..600)
multiplication_17 = Multiplication(A=number_of_bays_y_direction_9, B=distance_between_columns_18)
series_9 = Series(Start=0, Step=distance_between_floors_9, Count=number_of_floors_9)
multiplication_18 = Multiplication(A=number_of_bays_x_direction_9, B=distance_between_columns_17)
planesrf_11 = PlaneSurface(Plane=PlaneXY(0, 0, 0), XSize=multiplication_18, YSize=multiplication_17)
sdivide_9 = DivideSurface(Surface=planesrf_11, UCount=number_of_bays_x_direction_9, VCount=number_of_bays_y_direction_9)  # -> flatten(Points), Normals, Parameters
flip_9 = FlipMatrix(Data=sdivide_9.Parameters)
pline_25 = PolyLine(Vertices=sdivide_9.Parameters, Closed=False)
pline_26 = PolyLine(Vertices=flip_9, Closed=False)
explode_22 = Explode(Curve=[pline_25, pline_26], Recursive=True)  # -> Segments, Vertices
Z_40 = UnitZ(Factor=series_9)
# Structural elements
number_slider_10 = Slider(0, range=0..1)
len_9 = Length(Curve=explode_22.Segments)
move_33 = Move(Geometry=planesrf_11, Motion=Z_40)  # -> Geometry, Transform
division_9 = Division(A=len_9, B=Slider(2, range=0..10))
move_34 = Move(Geometry=sdivide_9.Points, Motion=graft(Z_40))  # -> Geometry, Transform
divide_17 = DivideCurve(Curve=explode_22.Segments, Count=division_9, Kinks=False)  # -> Points, Tangents, Parameters
ln_11 = Line(StartPoint=move_34.Geometry, EndPoint=sdivide_9.Points)
cull_i_21 = CullIndex(List=move_33.Geometry, Indices=number_slider_10, Wrap=True)
pline_27 = PolyLine(Vertices=divide_17.Points, Closed=False)
move_35 = Move(Geometry=pline_27, Motion=Z_40)  # -> Geometry, Transform
mesh_uv_9 = MeshSurface(Surface=cull_i_21, UCount=5, VCount=5, Overhang=True, Equalize=False)  # -> flatten(Mesh)
cull_i_22 = CullIndex(List=move_35.Geometry, Indices=Slider(0, range=0..1), Wrap=True)
explode_23 = Explode(Curve=cull_i_22, Recursive=distance_between_columns_17)  # -> Segments, Vertices
linetobeam_17 = LineToBeamKaramba3D(
    Line=explode_23.Segments,
    Identifier="Beam",
    New=True,
    Remove=True,
    LimitDistance_m=0.005,
    Bending=True,
    SetBucklingLength=True,
    ToPolylineMaxAngle=0.03,
    ToPolylineTolerance=0.01,
    ToPolylineMaxEdgeLength=0.25)  # -> Element, Points, Info

# ----
# Mesh Load
mesh_9 = Mesh(flatten(mesh_uv_9))
area_11 = Area(Geometry=mesh_9)  # -> Area, Centroid
Z_41 = UnitZ(Factor="1")
scale_11 = Scale(Geometry=mesh_9, Center=area_11.Centroid, Factor="1.8")  # -> flatten(Geometry), Transform
load_kn_m2_9 = Panel("-1")
Z_42 = UnitZ(Factor=load_kn_m2_9)
move_36 = Move(Geometry=scale_11.Geometry, Motion=Z_41)  # -> Geometry, Transform

area_12 = MeshArea(Mesh=move_33.Geometry)  # -> Area, Centroid
cull_i_23 = CullIndex(List=area_12.Centroid, Indices=Slider(6, range=0..10), Wrap=True)
cps_3 = ClosestPoints(Point=cull_i_23, Cloud=flatten(move_34.Geometry), Count=5)  # -> ClosestPoint, CPIndex, Distance
cull_i_24 = CullIndex(List=cps_3.ClosestPoint, Indices="0", Wrap=True)
loads_18 = LoadsKaramba3D(Vector=Z_42, Mesh=move_36.Geometry, LCase="1", mode="MeshLoad -Const.", menu=[buttons(off, on, off), buttons(on, on)])
item_19 = ListItem(List=cull_i_24, Index=panel_11, Wrap=True)
item_20 = ListItem(List=cull_i_24, Index=panel_12, Wrap=True)

# ----
# Loads
# list of loads
merge_34 = Merge(Data1=loads_9, Data2=loads_18)  # -> flatten(Result)

pl_5 = ConstructPlane(Origin=item_19, XAxis=Y_3, YAxis=Z_20)
pl_6 = ConstructPlane(Origin=item_20, XAxis=X_3, YAxis=Z_21)
vec_3 = VectorXYZ(XComponent=0, YComponent=0, ZComponent=distance_between_floors_9)  # -> Vector, Length
item_21 = ListItem(List=cps_3.ClosestPoint, Index="0", Wrap=True)
scale_12 = Scale(Geometry=[pl_5, pl_6], Center=item_21, Factor="0.5")  # -> Geometry, Transform
planesrf_12 = PlaneSurface(Plane=scale_12.Geometry, XSize="-1 to 1", YSize=vec_3.Vector)  # -> flatten(Plane)
demesh_3 = DeconstructMesh(Mesh=planesrf_12)  # -> Vertices, Faces, Colours, Normals
# Run the Data Dam
item_22 = ListItem(List=flatten(demesh_3.Vertices), Index=panel_15, Wrap=True)
pt_9 = Point([sdivide_9.Points, item_22])
rdpoints_3 = RemoveDuplicatePointsKaramba3D(Point=pt_9, LimitDistance=0.005)  # -> OutPoint, Info, Indexes

# ----
# supports
xy_9 = XYPlane(Origin=Point(0, 0, 0))
supp_9 = SupportKaramba3D(PosInd=flatten(rdpoints_3.OutPoint), PlaneOfReference=xy_9, menu=[buttons(on, on, on, on, on, on)])

item_23 = ListItem(List=flatten(demesh_3.Vertices), Index=panel_18, Wrap=True)
ln_12 = Line(StartPoint=item_23, EndPoint=item_22)

linetobeam_18 = LineToBeamKaramba3D(
    Line=[ln_11, ln_12],
    Identifier="Column",
    New=True,
    Remove=True,
    LimitDistance_m=0.005,
    Bending=True,
    SetBucklingLength=True,
    ToPolylineMaxAngle=0.03,
    ToPolylineTolerance=0.01,
    ToPolylineMaxEdgeLength=0.25)  # -> Element, Points, Info
meshtoshell_9 = MeshToShellKaramba3D(Mesh=[mesh_uv_9, planesrf_12], Identifier="Slab", LimitDistance_m=0.005)  # -> Element, Points, Info
merge_35 = Merge(Data1=meshtoshell_9.Element, Data2=linetobeam_18.Element, Data3=linetobeam_17.Element)

assemble_9 = AssembleModelKaramba3D(
    Elem=flatten(merge_35),
    Support=flatten(supp_9),
    Load=merge_34,
    CrossSection=merge_15,
    Material=matselect_6,
    LimitDistance_m=0.005)  # -> Model, Info, Mass_kg, CenterOfGravity, LoadCaseNames
panel_32 = Panel(assemble_9.Mass_kg)
dam_9 = DataDam(DataA=assemble_9.Model, BufferDelay=10000000, BufferMode=0)
nvibes_9 = NaturalVibrationsKaramba3D(Model=dam_9, FromIndex=1, NumberOfModes=Slider(1, range=0..10), MaximumNumberOfIterations=30, Epsilon=1e-05)  # -> ModelWithVibrationModesAsLoadCaseResults, flatten(NaturalFrequencies_Hz), ModalMass_kg, expr("abs(x)", ParticipationFactorInGlobalXYAndZDirection)
participation_factor_9 = Panel(nvibes_9.ParticipationFactorInGlobalXYAndZDirection)
natural_frequency_9 = Panel(nvibes_9.NaturalFrequencies_Hz)
modelview_9 = ModelViewKaramba3D(Model=nvibes_9.ModelWithVibrationModesAsLoadCaseResults, DisplacementDirection=yz_6, ResultFactors=1, ResultCase=-1)  # -> Model, DeformedMesh, DeformedAxes, DeformedModel
shellview_9 = ShellViewKaramba3D(Model=modelview_9.Model, IndexOfLayer=0)  # -> Model, MeshesOfRenderedShells, LegendColors, LegendTags
beamview_9 = BeamViewKaramba3D(Model=modelview_9.Model)  # -> Model, MeshesOfRenderedBeams, DeformedBeamAxes, LegendColors, LegendTags
legend_17 = Legend(Colour=shellview_9.LegendColors, Tags=shellview_9.LegendTags, LegendType=1)
legend_18 = Legend(Colour=beamview_9.LegendColors, Tags=beamview_9.LegendTags, LegendType=1)
crv_17 = Curve(modelview_9.DeformedAxes)
item_24 = ListItem(List=crv_17, Index=Slider(369, range=0..394), Wrap=True)
crv_18 = Curve(item_24)
join_17 = JoinCurves(Curves=crv_18, Preserve=False)
divide_18 = DivideCurve(Curve=join_17, Count=Slider(6, range=0..10), Kinks=False)  # -> expr("round(x,3)", reverse(flatten(Points))), Tangents, Parameters
expression_33 = Expression(x=divide_18.Points, Expression="abs(x)")
pdecon_9 = Deconstruct(Point=expression_33)  # -> XComponent, YComponent, ZComponent
ma_17 = MassAddition(Input=pdecon_9.YComponent)  # -> Result, PartialResults
# Extraction of displacement in a plane
ma_18 = MassAddition(Input=pdecon_9.XComponent)  # -> Result, PartialResults
expression_34 = Expression(y=ma_17.Result, Expression="if(y=0, false, true)")
expression_35 = Expression(x=pdecon_9.XComponent, y=ma_18.Result, Expression="if(y=0, false, true)")
expression_36 = Expression(x=pdecon_9.ZComponent, Expression="ROUND(X,0)")
cull_17 = CullPattern(List=pdecon_9.YComponent, CullPattern=expression_34)
cull_18 = CullPattern(List=pdecon_9.XComponent, CullPattern=expression_35)
merge_36 = Merge(Data1=graft(cull_18), Data2=graft(cull_17), Data3=graft(expression_36))
join_18 = TextJoin(Text=merge_36, Join=",")  # -> flatten(Result)
# Displacement Values
panel_33 = Panel(join_18)
